# Grasshopper definition USC_components_for_grasshopper.gh (Grasshopper 1.0.8)
# plug-ins: LadybugGrasshopper

usc_sync = USCSyncCanvas(update=Toggle(True))  # -> report; inputs update: Boolean, folder: String
# ---------- usc_sync: Python ----------
"""USC Sync Canvas — Update the USC components on this canvas.

Compares every USC component on the canvas with the installed USC user
objects (.ghuser) and brings outdated ones up to date. With update
unset or False it only reports; nothing on the canvas changes.

A component whose inputs and outputs are unchanged is replaced in place:
same position, every wire, internalised input values ("Set One String"),
data mappings (graft/flatten), preview/enabled state and group membership
carry over. A component whose inputs or outputs changed cannot be rewired
safely, so the new version is placed beside the old one and both are
wrapped in a red group: rewire the new one, then delete the old one.
The whole update is one undo step (Ctrl+Z).

Components with edited code count as outdated and are overwritten:
run with update=False first and read the report.

Inputs
------
update : bool, optional
    True = apply the update (use a Button). Default False: report only.
folder : str, optional
    Folder holding the USC .ghuser files to sync to. Default: the
    Grasshopper User Objects folders, where the installed versions live.

Outputs
-------
report : str
    What is up to date, what was (or would be) replaced, and what needs
    manual rewiring.
"""

import base64
import os

try:
    ghenv.Component.Name = "USC Sync Canvas"
    ghenv.Component.NickName = "USC_Sync"
    ghenv.Component.Description = "Updates the USC components on this canvas to the installed versions. Unchanged inputs/outputs: replaced in place, keeping wires and internalised values. Changed inputs/outputs: new version placed beside the old one inside a red group for manual rewiring. Report only unless update=True; one undo step."
    ii = ghenv.Component.Params.Input
    oo = ghenv.Component.Params.Output
    for i, (n, d) in enumerate([
        ("update", "True = apply the update (connect a Button). False or unconnected = only report what is out of date; nothing changes."),
        ("folder", "Optional folder containing the USC .ghuser files to update to. Default: the Grasshopper User Objects folders (File > Special Folders > User Object Folder), where the installed versions live."),
    ]):
        if i < len(ii):
            ii[i].Name, ii[i].Description = n, d
    oo[0].Name, oo[0].Description = "report", "Per component: up to date, replaced in place, or placed beside the old one for manual rewiring (with the changed inputs/outputs)."
except Exception:
    pass

import traceback

import System
import Grasshopper
import scriptcontext as sc
from Grasshopper.Kernel import GH_Document, GH_RuntimeMessageLevel, GH_UserObject
from Grasshopper.Kernel.Special import GH_Group, GH_GroupBorder
from Grasshopper.Kernel.Undo import GH_UndoRecord
from GH_IO.Serialization import GH_LooseChunk

GROUP_TAG = "USC sync:"
GROUP_COLOUR = System.Drawing.Color.FromArgb(150, 205, 92, 92)
_ERROR_KEY = "usc_sync_error_{}".format(ghenv.Component.InstanceGuid)


def _installed(folder):
    """{component name: GH_UserObject} for the USC .ghuser files found."""
    roots = [folder] if folder else list(Grasshopper.Folders.UserObjectFolders)
    found, dupes = {}, []
    for root in roots:
        for dirpath, _dirs, files in os.walk(str(root)):
            for fn in files:
                if not (fn.startswith("USC ") and fn.lower().endswith(".ghuser")):
                    continue
                uo = GH_UserObject(os.path.join(dirpath, fn))
                name = uo.Description.Name
                if name in found:
                    dupes.append(os.path.join(dirpath, fn))
                else:
                    found[name] = uo
    return found, dupes


def _signature(obj):
    """(code, inputs, outputs) as stored in the component's serialized form."""
    chunk = GH_LooseChunk("sig")
    obj.Write(chunk)
    script = chunk.FindChunk("Script")
    code = None
    if script is not None and script.ItemExists("Text"):
        code = base64.b64decode(script.GetString("Text")).decode("utf-8").replace("\r\n", "\n")
    params = chunk.FindChunk("ParameterData")

    def ports(kind, count_key):
        out = []
        for i in range(params.GetInt32(count_key) if params else 0):
            p = params.FindChunk(kind, i)
            hint = str(p.GetGuid("TypeHintID")) if p.ItemExists("TypeHintID") else ""
            access = p.GetInt32("ScriptParamAccess") if p.ItemExists("ScriptParamAccess") else 0
            out.append((p.GetString("Name"), access, hint))
        return out

    return code, ports("InputParam", "InputCount"), ports("OutputParam", "OutputCount")


def _sync_group(doc, obj):
    for g in doc.Objects:
        if isinstance(g, GH_Group) and str(g.NickName).startswith(GROUP_TAG) \
                and obj.InstanceGuid in g.ObjectIDs:
            return g
    return None


def _plan(doc, installed, me):
    """Classify every USC component on the canvas."""
    plan = {"current": [], "replace": [], "beside": [], "pending": [], "unknown": []}
    for obj in list(doc.Objects):
        if not isinstance(obj, Grasshopper.Kernel.IGH_Component) or obj.InstanceGuid == me:
            continue
        name = str(obj.Name)
        if not name.startswith("USC "):
            continue
        uo = installed.get(name)
        if uo is None:
            plan["unknown"].append(name)
            continue
        new = uo.InstantiateObject()
        old_sig, new_sig = _signature(obj), _signature(new)
        if old_sig == new_sig:
            plan["current"].append(name)
            continue
        same_ports = [p[0] for p in old_sig[1]] == [p[0] for p in new_sig[1]] and \
            [p[0] for p in old_sig[2]] == [p[0] for p in new_sig[2]]
        if same_ports:
            plan["replace"].append((obj, new))
        elif _sync_group(doc, obj) is not None:
            plan["pending"].append(name)  # already placed beside, awaiting rewiring
        else:
            plan["beside"].append((obj, new, _port_diff(old_sig, new_sig)))
    return plan


def _port_diff(old_sig, new_sig):
    parts = []
    for label, o, n in (("inputs", old_sig[1], new_sig[1]), ("outputs", old_sig[2], new_sig[2])):
        on, nn = [p[0] for p in o], [p[0] for p in n]
        added = [x for x in nn if x not in on]
        removed = [x for x in on if x not in nn]
        if added:
            parts.append("new {}: {}".format(label, ", ".join(added)))
        if removed:
            parts.append("removed {}: {}".format(label, ", ".join(removed)))
        if on != nn and not added and not removed:
            parts.append("{} reordered".format(label))
    return "; ".join(parts)


def _copy_param_state(src, dst):
    dst.DataMapping = src.DataMapping
    dst.Reverse = src.Reverse
    dst.Simplify = src.Simplify
    data = getattr(src, "PersistentData", None)
    if data is not None and data.DataCount and getattr(dst, "PersistentData", None) is not None:
        dst.PersistentData.Clear()
        for path in data.Paths:
            for item in data.get_Branch(path):
                if item is not None:
                    dst.PersistentData.Append(item.Duplicate(), path)


def _replace(doc, old, new, records):
    new.CreateAttributes()
    new.Attributes.Pivot = old.Attributes.Pivot
    new.Attributes.ExpireLayout()
    doc.AddObject(new, False)
    records.append(doc.UndoUtil.CreateAddObjectEvent("USC sync", new))
    for o, n in zip(old.Params.Input, new.Params.Input):
        _copy_param_state(o, n)
        for src in list(o.Sources):
            n.AddSource(src)
    for o, n in zip(old.Params.Output, new.Params.Output):
        n.DataMapping = o.DataMapping
        for rec in list(o.Recipients):
            records.append(doc.UndoUtil.CreateWireEvent("USC sync", rec))
            rec.ReplaceSource(o, n)
    new.Locked = old.Locked
    if hasattr(old, "Hidden"):
        new.Hidden = old.Hidden
    for g in list(doc.Objects):
        if isinstance(g, GH_Group) and old.InstanceGuid in g.ObjectIDs:
            records.append(doc.UndoUtil.CreateGenericObjectEvent("USC sync", g))
            g.AddObject(new.InstanceGuid)
            g.RemoveObject(old.InstanceGuid)
    records.append(doc.UndoUtil.CreateRemoveObjectEvent("USC sync", old))
    doc.RemoveObject(old, False)


def _place_beside(doc, old, new, note, records):
    new.CreateAttributes()
    bounds = old.Attributes.Bounds
    new.Attributes.Pivot = System.Drawing.PointF(
        old.Attributes.Pivot.X + bounds.Width + 60, old.Attributes.Pivot.Y)
    new.Attributes.ExpireLayout()
    doc.AddObject(new, False)
    records.append(doc.UndoUtil.CreateAddObjectEvent("USC sync", new))
    group = GH_Group()
    group.CreateAttributes()
    group.NickName = "{} {}. Rewire the new {} (right), then delete the old one (left).".format(
        GROUP_TAG, note, old.Name)
    group.Colour = GROUP_COLOUR
    group.Border = GH_GroupBorder.Blob
    group.AddObject(old.InstanceGuid)
    group.AddObject(new.InstanceGuid)
    doc.AddObject(group, False)
    records.append(doc.UndoUtil.CreateAddObjectEvent("USC sync", group))


def _merged(records):
    """One undo record holding every action, in the order they happened."""
    merged = GH_UndoRecord("USC Sync Canvas")
    for rec in records:
        for action in rec.Actions:
            merged.AddAction(action)
    return merged


def _apply(doc, plan, comp):
    """Runs between solutions. All or nothing: a failure rolls back."""
    records = []
    try:
        try:
            for old, new in plan["replace"]:
                _replace(doc, old, new, records)
            for old, new, note in plan["beside"]:
                _place_beside(doc, old, new, note, records)
        except Exception:
            sc.sticky[_ERROR_KEY] = traceback.format_exc()
            _merged(records).Undo(doc)
            records = []
        if records:
            doc.UndoServer.PushUndoRecord(_merged(records))
    except Exception:
        sc.sticky[_ERROR_KEY] = traceback.format_exc()
    finally:
        comp.ExpireSolution(False)  # re-run to report the post-update state


def _report(plan, applied, source, dupes, my_status):
    verb = ("replaced", "placed beside") if applied else ("would replace", "would place beside")
    lines = ["Source: {}".format(source)]
    if plan["replace"]:
        lines.append("{} in place ({}): {}".format(
            verb[0].capitalize(), len(plan["replace"]),
            ", ".join(sorted(str(o.Name) for o, _ in plan["replace"]))))
    for old, _new, note in plan["beside"]:
        lines.append("{} {} (I/O changed: {})".format(verb[1].capitalize(), old.Name, note))
    if plan["pending"]:
        lines.append("Awaiting manual rewiring (red groups): " + ", ".join(sorted(plan["pending"])))
    lines.append("Up to date ({}): {}".format(
        len(plan["current"]), ", ".join(sorted(plan["current"])) or "-"))
    if plan["unknown"]:
        lines.append("No installed .ghuser for: " + ", ".join(sorted(set(plan["unknown"]))))
    if dupes:
        lines.append("Duplicate .ghuser files ignored: " + "; ".join(dupes))
    if my_status:
        lines.append(my_status)
    if not applied and (plan["replace"] or plan["beside"]):
        lines.append("Set update=True to apply (one undo step).")
    return "\n".join(lines)


report = None
_doc = ghenv.Component.OnPingDocument()
_folder = str(folder).strip() if globals().get("folder") else None
if _folder and not os.path.isdir(_folder):
    report = "ERROR: folder not found: {}".format(_folder)
elif _doc is not None:
    _found, _dupes = _installed(_folder)
    if not _found:
        report = "ERROR: no USC .ghuser files found in {}".format(
            _folder or "the Grasshopper User Objects folders")
    else:
        _plan_now = _plan(_doc, _found, ghenv.Component.InstanceGuid)
        _mine = _found.get(str(ghenv.Component.Name))
        _my_status = None
        if _mine is not None and _signature(_mine.InstantiateObject())[0] != _signature(ghenv.Component)[0]:
            _my_status = "This USC Sync Canvas is itself outdated: drag a fresh one from the ribbon."
        _last_error = sc.sticky.pop(_ERROR_KEY, None)
        _apply_now = bool(globals().get("update")) and not _last_error and \
            bool(_plan_now["replace"] or _plan_now["beside"])
        if _apply_now:
            # The canvas cannot change mid-solution: apply right after it.
            _me = ghenv.Component
            _doc.ScheduleSolution(5, GH_Document.GH_ScheduleDelegate(
                lambda d: _apply(d, _plan_now, _me)))
        report = _report(_plan_now, _apply_now, _folder or "installed user objects", _dupes, _my_status)
        if _last_error:
            ghenv.Component.AddRuntimeMessage(
                GH_RuntimeMessageLevel.Error,
                "Update failed and was rolled back; the canvas is unchanged. See report.")
            report = "UPDATE FAILED, rolled back:\n{}\n{}".format(_last_error, report)
# ---------- end usc_sync ----------

# ----
# chaining multiple criteria
new_building = Geometry(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)
neighbor_windows = Geometry([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])
neighbor_roofs = Geometry([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])
neighbor_buildings = Geometry([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])

# ----
# Urban Solar Carver GH Demo
# 1. launch new USC persistent session
usc_root_folder_path = Panel("")
toggle = BooleanToggle(True)
usc_session = USCSession(carver_root=usc_root_folder_path, start_daemon=toggle, verbose=toggle)  # -> session, status; inputs carver_root: String, start_daemon: Boolean, verbose: Boolean
# ---------- usc_session: Python ----------
"""USC Session — Establish connection to UrbanSolarCarver backend.

Sets up the Python environment and optionally starts the CUDA daemon
for persistent GPU sessions (essential for Grasshopper workflows).

Inputs
------
carver_root : str
    Path to the UrbanSolarCarver repository root. The backend Python is
    located automatically: .venv/ or venv/ inside the root, or the path
    written in an optional <root>/python_path.txt override file (one line,
    full path to the python executable — useful when the venv lives
    elsewhere on the machine).
start_daemon : bool, optional
    True (default) = start daemon if not running. False = report only.
verbose : bool, optional
    True = show daemon console window for debugging.

Outputs
-------
session : dict
    Opaque session handle passed to all other USC components.
    Contains: root, python_path, authkey, host, port, daemon_pid.
status : str
    "ready" | "starting" | "no_daemon" | "error: ..."
"""

import os
import socket
import subprocess
import time
from pathlib import Path

# -- Session handle (non-iterable so GH treats it as a single item) ---------
class USCSession:
    """Opaque session handle. Not iterable — GH won't unpack it into a list."""
    __slots__ = ("root", "python_path", "authkey", "host", "port", "daemon_running")

    def __init__(self, root, python_path, authkey, host, port, daemon_running):
        self.root = root
        self.python_path = python_path
        self.authkey = authkey
        self.host = host
        self.port = port
        self.daemon_running = daemon_running

    def __repr__(self):
        state = "connected" if self.daemon_running else "no daemon"
        return "USCSession({}, {})".format(self.host + ":" + str(self.port), state)


# -- Constants ---------------------------------------------------------------
HOST = "localhost"
PORT = 6000
DETACHED_PROCESS = 0x00000008
CREATE_NEW_PROCESS_GROUP = 0x00000200
CREATE_NO_WINDOW = 0x08000000
CREATE_NEW_CONSOLE = 0x00000010

# -- GH UI rollovers --------------------------------------------------------
try:
    ghenv.Component.Name = "USC Session"
    ghenv.Component.NickName = "USC_Session"
    ghenv.Component.Description = "Connects to the UrbanSolarCarver computation daemon. The daemon keeps the GPU context alive between runs for fast iteration. Place this component once and wire 'session' to USC_Config."
    ii = ghenv.Component.Params.Input
    oo = ghenv.Component.Params.Output
    ii[0].Name, ii[0].Description = "carver_root", "Path to the UrbanSolarCarver folder on your computer (the folder containing the 'src' subfolder). The Python environment is found automatically in '.venv' or 'venv' inside it; if your venv lives elsewhere, create a text file 'python_path.txt' in this folder containing the full path to python.exe. Right-click > Set One String, then paste the full path."
    ii[1].Name, ii[1].Description = "start_daemon", "Wire a Boolean True to launch the background computation server (daemon). If left unconnected (None) or False the daemon is NOT started — status will be 'no_daemon'. The daemon keeps the GPU warm between runs for fast iteration."
    if len(ii) > 2:
        ii[2].Name, ii[2].Description = "verbose", "Set to True to open a visible console window showing daemon activity. Useful for debugging if things go wrong. Leave False for normal use."
    oo[0].Name, oo[0].Description = "session", "Connection handle passed to the USC_Config component. Contains the daemon address and authentication. Do not modify."
    oo[1].Name, oo[1].Description = "status", "Current daemon state: 'ready' means the daemon is running and accepting jobs. 'starting' means it is loading. 'error:...' means something went wrong -- read the message."
except Exception:
    pass

# -- Helpers -----------------------------------------------------------------

def _venv_python(root):
    """Locate the backend Python interpreter.

    Search order:
      1. <root>/python_path.txt — a one-line text file containing the full
         path to a python executable.  Machine-specific override for venvs
         that live outside the repo (the file is gitignored).
      2. <root>/.venv  (Windows then POSIX layout — setup_env.py default)
      3. <root>/venv
    """
    root = Path(root)
    override = root / "python_path.txt"
    if override.is_file():
        try:
            cand = Path(override.read_text(encoding="utf-8").strip().strip('"'))
            if cand.is_file():
                return cand
        except Exception:
            pass
    for rel in (
        (".venv", "Scripts", "python.exe"),
        ("venv", "Scripts", "python.exe"),
        (".venv", "bin", "python"),
        ("venv", "bin", "python"),
    ):
        p = root.joinpath(*rel)
        if p.exists():
            return p
    return None


def _read_authkey(root):
    """Read daemon authkey from the shared keyfile.

    The daemon writes to ~/.urbansolarcarver/.daemon_authkey (user-specific,
    cross-platform).  Falls back to <repo_root>/.daemon_authkey for
    backward compatibility with older daemon versions.
    """
    # Primary: user-specific location (matches daemon.py _DEFAULT_KEYFILE)
    kf = Path.home() / ".urbansolarcarver" / ".daemon_authkey"
    if kf.is_file():
        return kf.read_bytes().strip()
    # Fallback: legacy repo-root location
    kf_legacy = Path(root).resolve() / ".daemon_authkey"
    if kf_legacy.is_file():
        return kf_legacy.read_bytes().strip()
    return None


def _port_open(host=HOST, port=PORT, timeout=0.3):
    """Check if the daemon port is listening."""
    try:
        with socket.create_connection((host, port), timeout=timeout):
            return True
    except (ConnectionRefusedError, OSError, socket.timeout):
        return False


def _ping_daemon(authkey, host=HOST, port=PORT):
    """Verify daemon responds to RPC ping."""
    if authkey is None:
        return False
    try:
        from multiprocessing.connection import Client as MPClient
        c = MPClient((host, port), authkey=authkey)
        c.send({"cmd": "ping"})
        resp = c.recv()
        c.close()
        # daemon sends {"status": "ok", "pid": ...}
        return resp.get("status") == "ok" if isinstance(resp, dict) else False
    except Exception:
        return False


def _start_daemon(root, verbose=False):
    """Launch the daemon subprocess with proper PYTHONPATH."""
    py = _venv_python(root)
    if py is None:
        return None

    # Use -m to invoke the daemon module (requires PYTHONPATH)
    cmd = [str(py), "-m", "urbansolarcarver.daemon",
           "--host", HOST, "--port", str(PORT)]

    # Set PYTHONPATH so the daemon can import urbansolarcarver
    env = os.environ.copy()
    src_dir = str(Path(root) / "src")
    env["PYTHONPATH"] = src_dir + os.pathsep + env.get("PYTHONPATH", "")

    if verbose:
        # Keep console open so user can see init messages and errors
        flags = CREATE_NEW_CONSOLE
        out, err = None, None
    else:
        flags = CREATE_NEW_PROCESS_GROUP | DETACHED_PROCESS
        out, err = subprocess.DEVNULL, subprocess.DEVNULL

    popen_kwargs = {}
    if os.name == "nt":
        popen_kwargs["creationflags"] = flags  # Windows-only argument
    proc = subprocess.Popen(
        cmd, env=env, cwd=str(root),
        stdout=out, stderr=err,
        **popen_kwargs,
    )
    return proc.pid


# -- Main logic --------------------------------------------------------------

# Defaults
if carver_root is None:
    session = None
    status = "error: carver_root is required"
else:
    root = Path(str(carver_root)).resolve()
    py = _venv_python(root)

    if py is None:
        session = None
        status = (
            "error: no Python interpreter found under " + str(root) + " — "
            "run setup_env.py to create .venv/, or write the full path to "
            "your python executable into <carver_root>/python_path.txt"
        )
    else:
        authkey = _read_authkey(root)
        port_open_now = _port_open()
        daemon_running = authkey is not None and port_open_now

        if not daemon_running and start_daemon:
            # Only launch if the port is not already open — prevents spawning a
            # second daemon when one is starting up but hasn't written the keyfile yet.
            pid = _start_daemon(root, verbose=bool(verbose)) if not port_open_now else None
            # Wait for daemon to become ready (CUDA+Warp init can take 15-25s)
            for attempt in range(60):  # 60 × 0.5s = 30s max
                time.sleep(0.5)
                authkey = _read_authkey(root)
                if authkey and _port_open() and _ping_daemon(authkey):
                    daemon_running = True
                    break

            if daemon_running:
                status = "ready"
            else:
                status = "starting (pid={})".format(pid) if pid else "error: daemon failed to launch"
        elif daemon_running:
            status = "ready"
        else:
            status = "no_daemon"

        session = USCSession(
            root=str(root),
            python_path=str(py),
            authkey=authkey,
            host=HOST,
            port=PORT,
            daemon_running=daemon_running,
        )
# ---------- end usc_session ----------

# ----
# multiple buildings
actual_building_volumes_to_compare = Geometry([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])
their_exposed_surfaces = Geometry(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)
building_footprints_extruded_to_max_heig = Geometry([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])  # "building footprints extruded to max height"

# ----
# plane intersecting a sphere
plane = Geometry(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)
# test geometries to play
sphere = Geometry(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)

# ----
# urban blocks, neighbours
# and courtyards
protected_surfaces = Geometry([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])
two_urban_blocks = Geometry([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])

# ----
# config file overrides
# switch off diagnostics for faster work
# (saves ~1.5 - 2s per run)
panel = Panel("20")
toggle_2 = BooleanToggle(True)
usc_benefit = USCBenefitParams(balance_temperature=panel, balance_offset="2")  # -> overrides; inputs balance_temperature: Double, balance_offset: Double, simulated_weights_path: String, include_harm: Boolean
# ---------- usc_benefit: Python ----------
"""USC Benefit Parameters — Control benefit-mode hour weighting.

Only used when mode = "benefit". Two weightings are available:

Simple weights (default): the balance temperature is the outdoor air
temperature at which a building is 'free-running' — it needs neither
heating nor cooling. Solar gains are credited only in hours colder than
balance_temperature - balance_offset (they offset heating demand);
warmer hours are simply not counted.

Simulated weights: connect a simulated_weights.json artifact (from
USC_SimulateWeights or `usc simulate-weights`) to replace the balance
rule with hourly weights from an ISO 13790 5R1C building simulation
(thermal lag, mass state). balance_* are then unused.

Inputs
------
balance_temperature : float, optional
    Balance-point temperature in degrees Celsius. Default: 15.0
balance_offset : float, optional
    Dead-band below the balance point in degrees Celsius. Default: 2.0
simulated_weights_path : str, optional
    Path to a simulated_weights.json artifact. When set, replaces the
    balance-point rule with the simulated hourly weights.
include_harm : bool, optional
    EXPERIMENTAL. Subtract summer-overheating (harm) contributions per
    sky patch. With simulated weights this uses the artifact's harm
    series; without, Ladybug's hot-hour composite. Default: False.

Outputs
-------
overrides : str
    Semicolon-joined key=value pairs for Config's overrides input.
"""

try:
    ghenv.Component.Name = "USC Benefit Params"
    ghenv.Component.NickName = "USC_Benefit"
    ghenv.Component.Description = "Sets benefit-mode hour weighting. Simple weights: balance-point temperature rule (solar gains credited in hours below balance - offset). Simulated weights: connect a simulated_weights.json artifact (USC_SimulateWeights) to weight hours by an ISO 13790 5R1C building simulation instead — captures thermal lag and mass state."
    ii = ghenv.Component.Params.Input
    oo = ghenv.Component.Params.Output
    for i, (n, d) in enumerate([
        ("balance_temperature", "Balance-point temperature (deg C): the outdoor temperature at which the building is free-running (no heating or cooling needed). Solar gain in hours below balance - offset is credited as heating benefit; warmer hours are not counted. Default 15 (Ladybug); typical range ~12 (commercial) to ~18 (residential), higher for older poorly insulated stock. UNUSED when simulated_weights_path is set."),
        ("balance_offset", "Dead-band (deg C) below the balance point: hours warmer than balance - offset are not credited. Must be >= 0 (0 = no dead-band). Default: 2.0 deg C. UNUSED when simulated_weights_path is set."),
        ("simulated_weights_path", "Optional path to a simulated_weights.json artifact (from USC_SimulateWeights or `usc simulate-weights`). When set, the balance-point rule is replaced by hourly weights from an ISO 13790 5R1C building simulation of a typical building — thermal lag, mass state, gain saturation. A full-year analysis period is then the natural choice."),
        ("include_harm", "EXPERIMENTAL boolean. True = also subtract summer-overheating contributions per sky patch (with simulated weights: the artifact's harm series, otherwise Ladybug's hot-hour composite). Without declared seasonal shading (shading_hot on USC_Archetype) the harm channel is conservatively overstated — treat as a bracketing scenario, not the default. Default: False."),
    ]):
        if i < len(ii):
            ii[i].Name, ii[i].Description = n, d
    oo[0].Name, oo[0].Description = "overrides", "Benefit mode settings formatted for USC_Config. Connect to Config's 'overrides' input. Only relevant when mode='benefit'."
except Exception:
    pass


def _warn(msg):
    try:
        from Grasshopper.Kernel import GH_RuntimeMessageLevel
        ghenv.Component.AddRuntimeMessage(GH_RuntimeMessageLevel.Warning, msg)
    except Exception:
        pass


_items = []
_weights = globals().get("simulated_weights_path")
if _weights:
    _weights = str(_weights)
    if ";" in _weights or "=" in _weights:
        _warn("simulated_weights_path contains ';' or '=' — unsupported in "
              "override strings. Move the artifact to a plainer path.")
    else:
        _items.append(f"simulated_weights_path={_weights}")
        if balance_temperature is not None or balance_offset is not None:
            _warn("Simulated weights are active: balance_temperature / "
                  "balance_offset are unused.")
if balance_temperature is not None:
    _items.append(f"balance_temperature={float(balance_temperature)}")
if balance_offset is not None:
    _items.append(f"balance_offset={float(balance_offset)}")
if globals().get("include_harm"):
    _items.append("include_harm=true")
overrides = ";".join(_items) if _items else None
# ---------- end usc_benefit ----------
usc_grid = USCGridSettings(voxel_size="1", grid_step="1")  # -> overrides; inputs voxel_size: Double, grid_step: Double, margin_frac: Double
# ---------- usc_grid: Python ----------
"""USC Grid Settings — Control voxel grid resolution and padding.

Inputs
------
voxel_size : float, optional
    Voxel edge length in meters. Smaller = finer but slower. Default: 1.0
grid_step : float, optional
    Surface sampling spacing in meters. Default: 1.0
margin_frac : float, optional
    Padding fraction around geometry bounding box. Default: 0.01

Outputs
-------
overrides : list of str
    Key=value pairs for grid parameters.
"""

try:
    ghenv.Component.Name = "USC Grid Settings"
    ghenv.Component.NickName = "USC_Grid"
    ghenv.Component.Description = "Controls voxel grid resolution and bounding-box padding. Smaller voxel_size = finer detail but slower. Start coarse (2-3 m) and refine."
    ii = ghenv.Component.Params.Input
    oo = ghenv.Component.Params.Output
    for i, (n, d) in enumerate([
        ("voxel_size", "Edge length of each voxel cube in meters. Smaller values = finer resolution but slower computation. Start with 2.0 for testing, use 1.0 or 0.5 for final results. Typical range: 0.5 to 5.0 m."),
        ("grid_step", "Spacing between sample points on the test surfaces, in meters. Controls how densely rays are cast. Should be similar to or smaller than voxel_size. Typical: 1.0 m."),
        ("margin_frac", "Padding added around the geometry as a fraction of the bounding box. Prevents edge artifacts. Default 0.01 (1%). Increase to 0.05 if you see clipping at boundaries."),
    ]):
        if i < len(ii):
            ii[i].Name, ii[i].Description = n, d
    oo[0].Name, oo[0].Description = "overrides", "Grid settings formatted for USC_Config. Connect to Config's 'overrides' input."
except Exception:
    pass

_items = []
for key, val in [
    ("voxel_size", voxel_size),
    ("grid_step", grid_step),
    ("margin_frac", margin_frac),
]:
    if val is not None:
        _items.append(f"{key}={float(val)}")
overrides = ";".join(_items) if _items else None
# ---------- end usc_grid ----------
usc_diag = USCDiagnostics(enable=toggle_2, plots=toggle_2)  # -> overrides; inputs enable: Boolean, plots: Boolean
# ---------- usc_diag: Python ----------
"""USC Diagnostics — Control diagnostic output for all pipeline stages.

Each stage always writes core JSON diagnostics (score statistics and
wall/CPU timings) to a ``diagnostics/`` subdirectory alongside the stage
artifacts.

The ``plots`` toggle additionally generates plot images (score
histograms, sky patch weight/intensity plots, threshold histograms).
These add matplotlib overhead, so they are off by default.  Image paths
are surfaced by the Preprocess and ThresholdStage components via their
``diag_images`` output, which can be fed directly to Ladybug's Image
Viewer component.

Inputs
------
enable : bool
    True = include detailed score statistics (median, std, percentiles)
    in the per-stage diagnostics JSON. Basic statistics (count, min,
    max, mean) and timings are always written. The detailed set adds
    sorting passes over the full score volume — slow on large grids.
    Default: False.
plots : bool, optional
    True = generate diagnostic plot images (score histograms, sky patch
    weight/intensity plots, threshold histograms).
    Default: False (no matplotlib overhead).

Outputs
-------
overrides : str
    Override string for USC Config.
    Connect to the ``overrides`` input of USC Config.
"""

try:
    ghenv.Component.Name = "USC Diagnostics"
    ghenv.Component.NickName = "USC_Diag"
    ghenv.Component.Description = "Controls diagnostic depth: detailed score statistics (enable) and plot images (plots). Basic JSON diagnostics (score range, timings) are always written by each stage. Enable for inspection and validation; disable for faster production runs."
    ii = ghenv.Component.Params.Input
    oo = ghenv.Component.Params.Output
    if len(ii) > 0:
        ii[0].Name, ii[0].Description = "enable", "True = include detailed score statistics (median, std, percentiles) in each stage's diagnostics JSON. Basic stats (count, min, max, mean) and timings are always written. Detailed stats add sorting passes over the full score volume — slow on large grids. Default: False."
    if len(ii) > 1:
        ii[1].Name, ii[1].Description = "plots", "True = generate diagnostic plot images (score histograms, sky dome plots) in each stage's diagnostics folder. Adds matplotlib overhead. Default: False."
    if len(oo) > 0:
        oo[0].Name, oo[0].Description = "overrides", "Diagnostics toggle formatted for USC_Config. Connect to Config's 'overrides' input."
except Exception:
    pass

parts = []
if enable is not None:
    parts.append(f"diagnostics={'true' if bool(enable) else 'false'}")
if plots is not None:
    parts.append(f"diagnostic_plots={'true' if bool(plots) else 'false'}")
elif enable is not None:
    # When plots is not connected, follow the enable toggle
    parts.append(f"diagnostic_plots={'true' if bool(enable) else 'false'}")

overrides = ";".join(parts) if parts else None
# ---------- end usc_diag ----------
merge = Merge(Data1=usc_benefit, Data2=usc_grid, Data3=usc_diag)

# ----
# 2. configure USC
# benefit = evaluates sky patch passive solar
# benefit and applies cumulative score to voxels
path_to_epw_if_required_by_mode = Panel("")
output_directory = Panel("")
list = ValueList({"tilted_plane", "time-based", "irradiance", "daylight", "benefit"}, selected="benefit")
usc_config = USCConfig(
    session=usc_session.session,
    mode=list,
    epw_path=path_to_epw_if_required_by_mode,
    out_dir=output_directory,
    overrides=merge)  # -> config, summary; inputs mode: String, epw_path: String, out_dir: String, config_yaml: String, overrides: list of String
# ---------- usc_config: Python ----------
"""USC Config — Assemble a carving configuration.

Creates a config handle from a mode selection and optional base YAML.
Connect parameter components (AnalysisPeriod, GridSettings, etc.) to
the overrides input for full control.

Inputs
------
session : dict
    Session handle from USC_Session.
mode : str
    Carving mode. One of: time-based, irradiance, benefit, daylight,
    tilted_plane, radiative_cooling.
epw_path : str, optional
    Path to EPW weather file. Required for all modes except tilted_plane.
out_dir : str
    Output directory for all pipeline artifacts.
config_yaml : str, optional
    Path to a base YAML config. If None, uses the mode-specific default
    from configs/.
overrides : list of str, optional
    Key=value override strings from parameter components.
    Multiple sources are merged (last wins for duplicate keys).

Outputs
-------
config : dict
    Opaque config handle for pipeline components.
    Contains: yaml_path, overrides_dict, mode, out_dir, session.
summary : str
    Human-readable summary of the configuration.
"""

from pathlib import Path


class USCConfig:
    """Opaque config handle. Not iterable — GH treats it as a single item."""
    __slots__ = ("session", "yaml_path", "overrides", "mode", "out_dir")

    def __init__(self, session, yaml_path, overrides, mode, out_dir):
        self.session = session
        self.yaml_path = yaml_path
        self.overrides = overrides
        self.mode = mode
        self.out_dir = out_dir

    def __repr__(self):
        return "USCConfig({})".format(self.mode)


# -- GH UI rollovers --------------------------------------------------------
try:
    ghenv.Component.Name = "USC Config"
    ghenv.Component.NickName = "USC_Config"
    ghenv.Component.Description = "Assembles a complete configuration from mode selection, file paths, and parameter overrides. Wire parameter components (Period, Grid, Threshold, etc.) into the 'overrides' input. Outputs a config handle for pipeline components."
    ii = ghenv.Component.Params.Input
    oo = ghenv.Component.Params.Output
    ii[0].Name, ii[0].Description = "session", "Session handle from the USC_Session component. Drag a wire from USC_Session's 'session' output to here."
    ii[1].Name, ii[1].Description = "mode", "Carving algorithm. Options: 'benefit' (heating-benefit envelope; hour weighting via balance point or, with USC_SimulateWeights, a 5R1C building simulation), 'time-based' (shadow-hour envelope), 'irradiance' (total solar radiation envelope), 'daylight' (CIE overcast daylight envelope), 'tilted_plane' (geometric daylight access angle), 'radiative_cooling' (experimental night-sky cooling)."
    ii[2].Name, ii[2].Description = "epw_path", "Full path to an EnergyPlus Weather (.epw) file for your location. Required for all modes except 'tilted_plane' and 'daylight'. Download from climate.onebuilding.org or ladybug.tools."
    ii[3].Name, ii[3].Description = "out_dir", "Folder where all results will be saved. A subfolder structure (preprocessing/, thresholding/, exporting/) is created automatically. Tip: use a fresh folder for each experiment."
    ii[4].Name, ii[4].Description = "config_yaml", "Optional. Path to a base YAML configuration file. If omitted, the tool picks a sensible default for your chosen mode. Only needed for advanced customisation."
    ii[5].Name, ii[5].Description = "overrides", "Optional parameter overrides from other USC components (Period, Grid, Threshold, etc.). Connect multiple override wires here -- they are merged automatically."
    # CRITICAL: set overrides input to List Access so GH passes all items
    # at once instead of running the component once per item.
    import Grasshopper
    ii[5].Access = Grasshopper.Kernel.GH_ParamAccess.list
    oo[0].Name, oo[0].Description = "config", "Configuration handle passed to pipeline components (USC_Preprocess, USC_RunAll, etc.). Contains all settings for the run. Do not modify."
    oo[1].Name, oo[1].Description = "summary", "Human-readable text showing the active mode, config file, output folder, and all override parameters. Check this to verify your setup before running."
except Exception:
    pass

# -- Helpers -----------------------------------------------------------------

def _flatten(x):
    """Flatten GH tree/lists/semicolon-joined strings into key=value pairs."""
    if x is None:
        return []
    if isinstance(x, str):
        # Split semicolon-delimited strings from parameter components
        return [s.strip() for s in x.split(";") if s.strip()]
    try:
        from ghpythonlib import treehelpers as th
        items = th.tree_to_list(x, retrieve_items=True)
    except Exception:
        items = x
    flat, stack = [], [items]
    while stack:
        cur = stack.pop()
        if isinstance(cur, (list, tuple)):
            stack.extend(reversed(cur))
        elif cur is not None:
            # Each item might also be semicolon-joined
            for s in str(cur).split(";"):
                s = s.strip()
                if s:
                    flat.append(s)
    return flat


def _mode_default_yaml(root, mode_str):
    """Return the mode-specific default config YAML path."""
    mode_map = {
        "time-based": "config_time_based.yaml",
        "timebased": "config_time_based.yaml",
        "time_based": "config_time_based.yaml",
        "irradiance": "config_irradiance.yaml",
        "benefit": "config_benefit.yaml",
        "daylight": "config_daylight.yaml",
        "tilted_plane": "config_tilted_plane.yaml",
        "tiltedplane": "config_tilted_plane.yaml",
        "radiative_cooling": "config_radiative_cooling.yaml",
        "radiativecooling": "config_radiative_cooling.yaml",
    }
    # Normalize: strip hyphens/underscores for flexible matching
    key = mode_str.replace("-", "").replace("_", "")
    fname = mode_map.get(mode_str) or mode_map.get(key)
    return Path(root) / "configs" / fname if fname else None


# -- Main logic --------------------------------------------------------------

config = None
summary = ""

if session is None:
    summary = "ERROR: connect a USC Session component"
elif mode is None:
    summary = "ERROR: select a carving mode"
elif out_dir is None:
    summary = "ERROR: specify an output directory"
else:
    # session is a USCSession object (attribute access, not dict)
    root = session.root
    mode_str = str(mode).strip().lower()

    # Normalize mode aliases to canonical form (what the schema validator expects)
    _mode_canonical = {
        "timebased": "time-based", "time_based": "time-based",
        "tiltedplane": "tilted_plane", "tilted-plane": "tilted_plane",
        "radiativecooling": "radiative_cooling", "radiative-cooling": "radiative_cooling",
    }
    mode_str = _mode_canonical.get(mode_str, mode_str)

    # Resolve YAML path
    if config_yaml is not None and str(config_yaml).strip():
        yaml_path = str(config_yaml)
    else:
        _default = _mode_default_yaml(root, mode_str)
        yaml_path = str(_default) if _default is not None else None

    if yaml_path is None:
        summary = "ERROR: unknown mode '{}'".format(mode_str)
    else:
        # Parse overrides into dict (last wins)
        override_items = _flatten(overrides)
        overrides_dict = {}
        for item in override_items:
            if "=" in item:
                k, v = item.split("=", 1)
                overrides_dict[k.strip()] = v.strip()

        # Always inject mode and out_dir
        overrides_dict["mode"] = mode_str
        overrides_dict["out_dir"] = str(out_dir)

        # Inject EPW if provided
        if epw_path is not None and str(epw_path).strip():
            overrides_dict["epw_path"] = str(epw_path)

        # Build config handle (non-iterable object, not dict)
        config = USCConfig(
            session=session,
            yaml_path=yaml_path,
            overrides=overrides_dict,
            mode=mode_str,
            out_dir=str(out_dir),
        )

        # Summary
        lines = [
            f"Mode: {mode_str}",
            f"YAML: {Path(yaml_path).name}",
            f"Output: {out_dir}",
        ]
        if epw_path:
            lines.append(f"EPW: {Path(str(epw_path)).name}")
        if overrides_dict:
            param_keys = [k for k in overrides_dict if k not in ("mode", "out_dir", "epw_path")]
            if param_keys:
                lines.append(f"Overrides: {', '.join(param_keys)}")
        summary = "\n".join(lines)
# ---------- end usc_config ----------

# ----
# start with protecting 80% of available overcast sky illuminance for neighbor windows
list_2 = ValueList({"tilted_plane", "time-based", "irradiance", "daylight", "benefit"}, selected="daylight")
list_3 = ValueList({"carve_fraction", "otsu", "headtail"}, selected="carve_fraction")
output_directory_2 = Panel("")
usc_threshold = USCThreshold(method=list_3, value=Slider(0.8, range=0.1..1), carve_above=Toggle(True), carve_above_min="3")  # -> overrides; inputs method: String, value: Double, score_smoothing: Double, carve_above: Boolean, carve_above_min: Int32
# ---------- usc_threshold: Python ----------
"""USC Threshold — Control how the score volume is binarized.

The threshold determines which voxels are "obstructing" (removed) vs
"kept" (part of the final envelope).

Inputs
------
method : str, optional
    Threshold strategy. One of:
      "carve_fraction" — remove voxels accounting for X% of total score
      "headtail"       — head-tail breaks (for skewed distributions)
      "numeric"        — direct raw-score cutoff
    If None, uses the mode default (carve_fraction).
value : float, optional
    Meaning depends on method:
      carve_fraction → fraction of total obstruction to remove (0-1).
      headtail       → ignored (algorithm is automatic).
      numeric        → raw score threshold; voxels above are removed.
score_smoothing : float, optional
    Gaussian blur radius (meters) applied to the score volume before
    thresholding.  Smooths resolution-dependent noise so the carved
    mesh is cleaner at fine voxel sizes.
    None (default) = auto: 1.1 × voxel_size.
    0 = disabled.
    Positive value = explicit radius in meters (1.0–1.2× voxel_size
    recommended; over-smoothing above 2× rounds features).
    Only affects weighted-score modes (irradiance, benefit, daylight,
    radiative_cooling).
carve_above : bool, optional
    If True, carve all occupied voxels above the lowest
    sufficiently-carved region in each (x, y) column.  Removes
    structurally implausible floating mass above carved zones.
    Default: False.
carve_above_min : int, optional
    Minimum consecutive carved voxels in a column before carve_above
    activates for that column.  Higher values (2-3) prevent stray
    single-voxel carvings from triggering aggressive removal.
    Default: 1.

Outputs
-------
overrides : str
    Semicolon-joined key=value string for Config.
"""

try:
    ghenv.Component.Name = "USC Threshold"
    ghenv.Component.NickName = "USC_Threshold"
    ghenv.Component.Description = (
        "Controls how the carving threshold is determined, optional score smoothing, "
        "and column-based carve-above post-processing. "
        "'carve_fraction' (default) removes a percentage of total obstruction weight — most intuitive. "
        "'headtail' uses head-tail breaks for automatic statistical splitting. "
        "'numeric' applies a direct raw-score cutoff. "
        "score_smoothing applies Gaussian blur to scores before thresholding for cleaner results. "
        "carve_above removes floating occupied voxels above carved zones. "
        "Connect output to Config or directly to ThresholdStage."
    )
    ii = ghenv.Component.Params.Input
    oo = ghenv.Component.Params.Output
    for i, (n, d) in enumerate([
        ("method", (
            "How to determine the carving threshold. Options: "
            "'carve_fraction' (default, remove a percentage of total obstruction weight — most intuitive), "
            "'headtail' (automatic heavy-tail distribution split — value is ignored), "
            "'numeric' (direct raw-score cutoff — set the exact threshold via value)."
        )),
        ("value", (
            "Threshold parameter whose meaning depends on method:\n"
            "  carve_fraction → fraction to carve (0.0-1.0). "
            "0.7 = remove 70% of obstruction weight. Start with 0.5.\n"
            "  headtail → ignored (automatic).\n"
            "  numeric → raw score cutoff. Voxels scoring above this are removed."
        )),
        ("score_smoothing", (
            "Gaussian blur radius in meters applied to the score volume before thresholding. "
            "Smooths resolution-dependent noise so the carved mesh is cleaner at fine voxel sizes. "
            "Leave empty (default) = auto: 1.1× voxel_size — recommended for most runs. "
            "Set to 0 to disable smoothing entirely. "
            "Positive value = explicit radius in meters. Rule of thumb: 1.0–1.2× voxel_size works well. "
            "Over-smoothing (above 2× voxel_size) rounds features excessively. "
            "Only affects weighted-score modes (irradiance, benefit, daylight, radiative_cooling)."
        )),
        ("carve_above", (
            "If True, carve all occupied voxels above the lowest sufficiently-carved "
            "region in each (x, y) column. Removes structurally implausible floating mass "
            "above already-carved zones. Default: False (disabled)."
        )),
        ("carve_above_min", (
            "Minimum number of consecutive carved (empty) voxels in a column before "
            "carve_above activates for that column. Higher values (2-3) prevent stray "
            "single-voxel carvings from triggering aggressive column removal. Default: 1."
        )),
    ]):
        if i < len(ii):
            ii[i].Name, ii[i].Description = n, d
    oo[0].Name, oo[0].Description = "overrides", (
        "Threshold, smoothing, and carve-above settings formatted for USC_Config or USC_ThresholdStage. "
        "Connect to ThresholdStage's 'threshold_overrides' for iterative "
        "adjustment without re-running preprocessing."
    )
except Exception:
    pass


_items = []

_m = str(method).strip().lower() if method is not None else None

if _m == "numeric":
    # 'numeric' is only a UI label — the pipeline needs the actual number.
    # Never emit the bare placeholder (the config schema rejects it).
    if value is not None:
        _items.append(f"threshold={float(value)}")
    else:
        try:
            from Grasshopper.Kernel import GH_RuntimeMessageLevel
            ghenv.Component.AddRuntimeMessage(
                GH_RuntimeMessageLevel.Warning,
                "method='numeric' needs a number in the 'value' input — "
                "no threshold override emitted (mode default will be used).",
            )
        except Exception:
            pass
elif _m in ("headtail", "carve_fraction"):
    _items.append(f"threshold={_m}")
    # carve_fraction: value is the fraction to carve; headtail ignores value.
    if _m == "carve_fraction" and value is not None:
        _items.append(f"carve_fraction={float(value)}")
elif _m is not None:
    # Might be a bare number (legacy shorthand for numeric threshold)
    try:
        float(_m)
        _items.append(f"threshold={_m}")
    except ValueError:
        pass  # invalid, ignore
elif value is not None:
    # No method connected: value maps to carve_fraction (the mode default).
    _items.append(f"carve_fraction={float(value)}")

if score_smoothing is not None:
    _items.append(f"score_smoothing={float(score_smoothing)}")

if carve_above is not None:
    _items.append(f"carve_above={'true' if bool(carve_above) else 'false'}")

if carve_above_min is not None:
    _items.append(f"carve_above_min_consecutive={int(carve_above_min)}")

overrides = ";".join(_items) if _items else None
# ---------- end usc_threshold ----------
usc_config_2 = USCConfig(
    session=usc_session.session,
    mode=list_2,
    epw_path=path_to_epw_if_required_by_mode,
    out_dir=output_directory_2,
    overrides=usc_threshold)  # -> config, summary; inputs mode: String, epw_path: String, out_dir: String, config_yaml: String, overrides: list of String; same code as usc_config
usc_runall = USCRunPipeline(config=usc_config_2.config, max_volume=new_building, test_surfaces=neighbor_windows, run=Toggle(False))  # -> mesh, export_path, report_path, diagnostics; inputs max_volume: list of Mesh, test_surfaces: list of Mesh, run: Boolean
# ---------- usc_runall: Python ----------
"""USC Run Pipeline — Execute the full carving pipeline in one step.

Takes Rhino geometry, exports to PLY, runs all three stages
(preprocessing → thresholding → exporting), and returns the
carved mesh directly to Grasshopper.

For finer control (e.g., adjusting threshold without re-carving),
use the individual stage components instead.

Inputs
------
config : USCConfig
    Config handle from USC Config.
max_volume : Mesh or Brep (list)
    Maximum volume envelope geometry.
test_surfaces : Mesh or Brep (list)
    Insolation test surfaces.
run : bool
    True to execute. False to idle (no computation).

Outputs
-------
mesh : Rhino.Geometry.Mesh
    Carved envelope mesh, ready for display in Rhino.
export_path : str
    Path to the exported mesh file on disk.
report_path : str
    Path to the run_report.md file summarising the full pipeline run.
diagnostics : str
    Summary of pipeline results (timings, voxel counts, mesh stats).
"""

import json
import os
import subprocess
import time
from pathlib import Path

import Rhino.Geometry as rg

# -- GH UI rollovers --------------------------------------------------------
try:
    ghenv.Component.Name = "USC Run Pipeline"
    ghenv.Component.NickName = "USC_RunAll"
    ghenv.Component.Description = "Runs the full pipeline (Preprocess + Threshold + Export) in one step. Convenient for quick prototyping. For iterative threshold adjustment, use the decomposed stage components instead."
    ii = ghenv.Component.Params.Input
    oo = ghenv.Component.Params.Output
    ii[0].Name, ii[0].Description = "config", "Configuration handle from USC_Config. Contains all settings for the full pipeline."
    ii[1].Name, ii[1].Description = "max_volume", "Maximum building envelope geometry (Mesh or Brep). Multiple objects accepted."
    ii[2].Name, ii[2].Description = "test_surfaces", "Surfaces requiring solar access (Mesh or Brep), one or many."
    ii[3].Name, ii[3].Description = "run", "Boolean toggle. True to run the complete pipeline (preprocessing + thresholding + exporting) in one step."
    oo[0].Name, oo[0].Description = "mesh", "The carved envelope as a Rhino Mesh. Displayed directly in the viewport."
    oo[1].Name, oo[1].Description = "export_path", "Full path to the exported mesh file on disk."
    oo[2].Name, oo[2].Description = "report_path", "Full path to the run_report.md file. Contains a human-readable summary of the entire pipeline run."
    oo[3].Name, oo[3].Description = "diagnostics", "Summary of the full pipeline run: per-stage timings, voxel counts, final mesh statistics."
except Exception:
    pass

# -- Geometry helpers --------------------------------------------------------

def _fine_mesh_params():
    """Meshing parameters that preserve geometry detail for carving."""
    mp = rg.MeshingParameters()
    mp.MaximumEdgeLength = 0
    mp.MinimumEdgeLength = 0.001
    mp.GridAspectRatio = 0
    mp.GridAngle = 0
    mp.GridMaxCount = 0
    mp.RefineGrid = True
    mp.JaggedSeams = False
    mp.SimplePlanes = True
    mp.Tolerance = 0.01
    mp.RelativeTolerance = 0.0
    return mp

def _to_rhino_mesh(geom):
    """Convert Brep or Mesh to a triangulated Rhino Mesh."""
    if isinstance(geom, rg.Mesh):
        m = geom.DuplicateMesh()
        m.Faces.ConvertQuadsToTriangles()
        m.Normals.ComputeNormals()
        m.Compact()
        return m
    if isinstance(geom, rg.Brep):
        meshes = rg.Mesh.CreateFromBrep(geom, _fine_mesh_params())
        if meshes:
            combined = rg.Mesh()
            for m in meshes:
                combined.Append(m)
            combined.Faces.ConvertQuadsToTriangles()
            combined.Vertices.CombineIdentical(True, True)
            combined.Faces.CullDegenerateFaces()
            combined.Normals.ComputeNormals()
            combined.Compact()
            return combined
    return None

def _flatten_geometry(items):
    """Extract Rhino Meshes from GH input (handles trees, wrappers, goo)."""
    if items is None:
        return []
    if not isinstance(items, (list, tuple)):
        items = [items]
    meshes = []
    for item in items:
        geo = item
        if hasattr(geo, "Value"):
            geo = geo.Value
        if hasattr(geo, "CastToMesh"):
            m = rg.Mesh()
            if geo.CastToMesh(m):
                geo = m
        elif hasattr(geo, "CastTo"):
            try:
                success, result = geo.CastTo[rg.Mesh]()
                if success:
                    geo = result
            except Exception:
                pass
        m = _to_rhino_mesh(geo)
        if m is not None:
            meshes.append(m)
    return meshes

def _export_mesh_to_ply(mesh, path, include_normals=True):
    """Write a triangulated Rhino Mesh to binary PLY (little-endian).

    Uses .NET bulk array operations (ToFloatArray + Buffer.BlockCopy) to
    bypass per-vertex Python loops.  GhPython loops are significantly slower
    than C++/.NET bulk paths; this eliminates the vertex serialization
    bottleneck for large meshes.

    Parameters
    ----------
    include_normals : bool
        True for test surfaces (open/non-watertight) — normals let trimesh
        correctly orient faces via fix_normals().  False for max_volume
        (watertight) — explicit normals can cause trimesh to flip face winding
        during process=True loading, breaking inside/outside for voxelization
        (produces hollow shell instead of solid fill).
    """
    import struct
    import System

    mesh.Faces.ConvertQuadsToTriangles()
    mesh.Normals.ComputeNormals()
    nv = mesh.Vertices.Count
    nf = mesh.Faces.Count

    with open(path, "wb") as f:
        # -- Header --------------------------------------------------------
        props = "property float x\nproperty float y\nproperty float z\n"
        if include_normals:
            props += (
                "property float nx\nproperty float ny\nproperty float nz\n"
            )
        header = (
            "ply\nformat binary_little_endian 1.0\n"
            f"element vertex {nv}\n"
            f"{props}"
            f"element face {nf}\n"
            "property list uchar int vertex_indices\n"
            "end_header\n"
        )
        f.write(header.encode("ascii"))

        # -- Vertices (bulk .NET path) -------------------------------------
        # ToFloatArray() is a single C++ call returning float[nv*3]
        pos = mesh.Vertices.ToFloatArray()

        if include_normals:
            # Bulk normal extraction; fall back to per-element if the method
            # is unavailable in this Rhino version.
            try:
                nrm = mesh.Normals.ToFloatArray()
            except (AttributeError, TypeError):
                nrm = System.Array.CreateInstance(System.Single, nv * 3)
                norms_list = mesh.Normals
                for i in range(nv):
                    n = norms_list[i]
                    nrm[i * 3] = n.X
                    nrm[i * 3 + 1] = n.Y
                    nrm[i * 3 + 2] = n.Z

            # Interleave [x,y,z, nx,ny,nz] per vertex via .NET Array.Copy
            combined = System.Array.CreateInstance(System.Single, nv * 6)
            for i in range(nv):
                System.Array.Copy(pos, i * 3, combined, i * 6, 3)
                System.Array.Copy(nrm, i * 3, combined, i * 6 + 3, 3)

            nbytes = nv * 24
            vbuf = System.Array.CreateInstance(System.Byte, nbytes)
            System.Buffer.BlockCopy(combined, 0, vbuf, 0, nbytes)
            f.write(bytes(bytearray(vbuf)))
        else:
            # Zero Python loops: bulk extract → byte copy → write
            nbytes = nv * 12
            vbuf = System.Array.CreateInstance(System.Byte, nbytes)
            System.Buffer.BlockCopy(pos, 0, vbuf, 0, nbytes)
            f.write(bytes(bytearray(vbuf)))

        # -- Faces (all triangles after ConvertQuadsToTriangles) -----------
        faces = mesh.Faces
        fbuf = bytearray(nf * 13)  # 1 byte count + 3×4 byte indices
        for i in range(nf):
            face = faces[i]
            struct.pack_into("<Biii", fbuf, i * 13, 3, face.A, face.B, face.C)
        f.write(fbuf)


def _load_ply_to_rhino(path):
    """Load a PLY file into Rhino Mesh using batch array operations.

    Parses binary-LE or ASCII PLY, handling arbitrary vertex property layouts
    (e.g. x/y/z/nx/ny/nz when trimesh exports normals after fix_normals()).
    Uses the actual per-vertex byte stride from the header so that x/y/z are
    read at the correct offsets regardless of how many extra properties exist.

    Uses System.Array-based AddVertices/AddFaces for ~10-50x speedup over
    per-element Add calls.  Face data is read in a single I/O call and
    parsed with struct.unpack_from to avoid 2×nf individual f.read() calls.
    """
    import struct
    import System

    _PLY_SIZES = {
        "char": 1, "uchar": 1, "short": 2, "ushort": 2,
        "int": 4, "uint": 4, "float": 4, "double": 8,
        "int8": 1, "uint8": 1, "int16": 2, "uint16": 2,
        "int32": 4, "uint32": 4, "float32": 4, "float64": 8,
    }

    nv = nf = 0
    is_binary_le = False
    vertex_props = []   # [(name, byte_size), ...]
    in_vertex = False

    with open(path, "rb") as f:
        # Parse header — track vertex property list to compute stride
        first = True
        while True:
            raw_line = f.readline()
            if not raw_line:
                # EOF before end_header: not a PLY (or truncated).  Without
                # this guard, readline() returns b"" forever → infinite loop.
                raise ValueError(
                    "Not a valid PLY file (no end_header found): {}".format(path)
                )
            line = raw_line.decode("ascii", errors="replace").strip()
            if first:
                if line != "ply":
                    raise ValueError(
                        "Not a PLY file (missing 'ply' magic): {}".format(path)
                    )
                first = False
                continue
            if line == "end_header":
                break
            if "binary_little_endian" in line:
                is_binary_le = True
            elif line.startswith("element vertex"):
                nv = int(line.split()[-1])
                in_vertex = True
                vertex_props = []
            elif line.startswith("element"):
                in_vertex = False
                if "face" in line:
                    nf = int(line.split()[-1])
            elif line.startswith("property") and in_vertex:
                parts = line.split()
                if len(parts) >= 3 and parts[1] != "list":
                    vertex_props.append((parts[2], _PLY_SIZES.get(parts[1], 4)))

        # Compute per-vertex byte stride and x/y/z offsets
        stride = sum(sz for _, sz in vertex_props) or 12
        xyz_off = {}
        off = 0
        for pname, psize in vertex_props:
            if pname in ("x", "y", "z"):
                xyz_off[pname] = off
            off += psize
        xo = xyz_off.get("x", 0)
        yo = xyz_off.get("y", 4)
        zo = xyz_off.get("z", 8)

        if is_binary_le:
            raw = f.read(nv * stride)
            if stride == 12 and xo == 0 and yo == 4 and zo == 8:
                # Fast path: xyz-only layout (trimesh default, no normals)
                verts = struct.unpack(f"<{nv * 3}f", raw)
            else:
                # General path: extract x/y/z at their actual byte offsets
                verts = []
                for i in range(nv):
                    base = i * stride
                    verts.append(struct.unpack_from("<f", raw, base + xo)[0])
                    verts.append(struct.unpack_from("<f", raw, base + yo)[0])
                    verts.append(struct.unpack_from("<f", raw, base + zo)[0])
            # Bulk-read all face data at once (avoids 2×nf individual reads)
            face_data = f.read()
            faces = []
            foff = 0
            for _ in range(nf):
                count = struct.unpack_from("<B", face_data, foff)[0]
                foff += 1
                faces.append(
                    struct.unpack_from(f"<{count}i", face_data, foff)
                )
                foff += count * 4
        else:
            f.seek(0)
            text = f.read().decode("ascii", errors="replace").split("\n")
            ds = 0
            for i, ln in enumerate(text):
                if ln.strip() == "end_header":
                    ds = i + 1
                    break
            verts = []
            for i in range(nv):
                p = text[ds + i].split()
                verts.extend((float(p[0]), float(p[1]), float(p[2])))
            faces = []
            for i in range(nf):
                p = text[ds + nv + i].split()
                c = int(p[0])
                faces.append(tuple(int(x) for x in p[1:c + 1]))

    mesh_out = rg.Mesh()

    pt_arr = System.Array.CreateInstance(rg.Point3d, nv)
    for i in range(nv):
        pt_arr[i] = rg.Point3d(verts[i * 3], verts[i * 3 + 1], verts[i * 3 + 2])
    mesh_out.Vertices.AddVertices(pt_arr)

    face_arr = System.Array.CreateInstance(rg.MeshFace, nf)
    for i, idx in enumerate(faces):
        if len(idx) == 3:
            face_arr[i] = rg.MeshFace(idx[0], idx[1], idx[2])
        else:
            face_arr[i] = rg.MeshFace(idx[0], idx[1], idx[2], idx[3])
    mesh_out.Faces.AddFaces(face_arr)

    mesh_out.Normals.ComputeNormals()
    return mesh_out


# -- RPC helper --------------------------------------------------------------

def _rpc_call(session, cmd, payload):
    """Send an RPC command to the daemon and return the response."""
    from multiprocessing.connection import Client as MPClient
    authkey = getattr(session, "authkey", None)
    if authkey is None:
        raise RuntimeError("No daemon authkey — start the daemon first")
    c = MPClient((session.host, session.port), authkey=authkey)
    c.send({"cmd": cmd, **payload})
    resp = c.recv()
    c.close()
    if isinstance(resp, dict) and resp.get("status") == "error":
        raise RuntimeError(resp.get("error", "Unknown error"))
    return resp


def _run_subprocess(session, config_dict):
    """Run the pipeline as a subprocess (fallback when no daemon)."""
    py = session.python_path
    root = session.root
    script = (
        "import sys; sys.path.insert(0, r'{root}/src'); "
        "from urbansolarcarver import load_config, run_pipeline; "
        "cfg = load_config(r'{yaml}', {overrides}); "
        "r = run_pipeline(cfg, r'{out_dir}'); "
        "print(r.export_path)"
    ).format(
        root=root,
        yaml=config_dict["yaml_path"],
        overrides=repr(["{0}={1}".format(k, v) for k, v in config_dict["overrides"].items()]),
        out_dir=config_dict["out_dir"],
    )

    result = subprocess.run(
        [py, "-c", script],
        capture_output=True,
        text=True,
        cwd=root,
    )
    if result.returncode != 0:
        raise RuntimeError(f"Pipeline failed:\n{result.stderr}")
    return result.stdout.strip()


# -- Main logic --------------------------------------------------------------

def _add_error(msg):
    """Surface an error on the GH component (turns it red) and return msg."""
    try:
        from Grasshopper.Kernel import GH_RuntimeMessageLevel
        ghenv.Component.AddRuntimeMessage(GH_RuntimeMessageLevel.Error, msg)
    except Exception:
        pass
    return msg


mesh = None
export_path = None
report_path = None
diagnostics = ""

if not run:
    diagnostics = "Idle — set run=True to execute"
elif config is None:
    diagnostics = _add_error("Connect a USC Config component")
elif max_volume is None:
    diagnostics = _add_error("Connect max_volume geometry")
elif test_surfaces is None:
    diagnostics = _add_error("Connect test_surfaces geometry")
else:
    t_start = time.perf_counter()
    session = config.session
    out_dir = config.out_dir
    overrides = dict(config.overrides)

    # Export geometry to PLY
    vol_meshes = _flatten_geometry(max_volume)
    srf_meshes = _flatten_geometry(test_surfaces)

    if not vol_meshes:
        diagnostics = _add_error("max_volume contains no valid geometry")
    elif not srf_meshes:
        diagnostics = _add_error("test_surfaces contains no valid geometry")
    else:
        # Combine into single meshes and weld seams left by Append:
        # merge duplicate vertices at Brep face boundaries so trimesh
        # sees a manifold watertight mesh for solid voxelization.
        vol_combined = rg.Mesh()
        for m in vol_meshes:
            vol_combined.Append(m)
        vol_combined.Vertices.CombineIdentical(True, True)
        vol_combined.Faces.CullDegenerateFaces()
        vol_combined.UnifyNormals()
        vol_combined.Compact()

        srf_combined = rg.Mesh()
        for m in srf_meshes:
            srf_combined.Append(m)
        # Do NOT weld test surfaces — see USC_Preprocess comment.

        # Write to temp PLY files in out_dir
        os.makedirs(out_dir, exist_ok=True)
        incoming = Path(out_dir) / "incoming"
        incoming.mkdir(exist_ok=True)

        vol_path = str(incoming / "max_volume.ply")
        srf_path = str(incoming / "test_surfaces.ply")
        _export_mesh_to_ply(vol_combined, vol_path, include_normals=False)
        _export_mesh_to_ply(srf_combined, srf_path, include_normals=True)

        # Inject geometry paths
        overrides["max_volume_path"] = vol_path
        overrides["test_surface_path"] = srf_path

        config_for_run = {"yaml_path": config.yaml_path, "overrides": overrides, "out_dir": out_dir}

        try:
            if getattr(session, "daemon_running", False):
                resp = _rpc_call(session, "run_pipeline", {
                    "config": config.yaml_path,
                    "overrides": [f"{k}={v}" for k, v in overrides.items()],
                    "out_dir": out_dir,
                })
                result_path = resp.get("export_path", "")
            else:
                result_path = _run_subprocess(session, config_for_run)

            # Load result mesh (canvas preview is PLY-only; other formats
            # are saved to disk without preview)
            export_path = result_path
            if os.path.isfile(result_path):
                if result_path.lower().endswith(".ply"):
                    mesh = _load_ply_to_rhino(result_path)
                else:
                    try:
                        from Grasshopper.Kernel import GH_RuntimeMessageLevel
                        ghenv.Component.AddRuntimeMessage(
                            GH_RuntimeMessageLevel.Remark,
                            "Mesh saved to {} — canvas preview only supports "
                            "PLY (set final_mesh_format=ply to preview)".format(result_path),
                        )
                    except Exception:
                        pass

            # Read diagnostics
            elapsed = time.perf_counter() - t_start
            diag_lines = [f"Total time: {elapsed:.1f}s"]

            # Try reading stage summaries
            for stage in ["preprocessing", "thresholding", "exporting"]:
                summary_path = Path(out_dir) / stage / "diagnostics" / "diagnostic.json"
                if summary_path.exists():
                    with open(summary_path) as f:
                        data = json.load(f)
                    if stage == "preprocessing":
                        dev = data.get("device")
                        if dev:
                            diag_lines.append(f"Device: {dev}")
                        stats = data.get("score_stats", {})
                        diag_lines.append(
                            f"Preprocessing: {data.get('voxels_filled', '?')} voxels, "
                            f"scores [{stats.get('min', 0):.1f} - {stats.get('max', 0):.1f}]"
                        )
                    elif stage == "thresholding":
                        diag_lines.append(
                            f"Thresholding: {data.get('threshold_method', '?')} "
                            f"(value={data.get('threshold_value', '?')}), "
                            f"kept {data.get('retention_pct', '?')}%"
                        )
                    elif stage == "exporting":
                        vol = data.get("mesh_volume_m3")
                        vol_str = f", vol={vol:.1f} m³" if vol is not None else ""
                        ret = data.get("voxel_retention_pct")
                        ret_str = f", retention={ret}%" if ret is not None else ""
                        diag_lines.append(
                            f"Exporting: {data.get('vertices', '?')} verts, "
                            f"{data.get('triangles', '?')} faces{vol_str}{ret_str}"
                        )

            # Run report
            rpt = Path(out_dir) / "run_report.md"
            if rpt.is_file():
                report_path = str(rpt)

            diagnostics = "\n".join(diag_lines)

        except Exception as e:
            diagnostics = _add_error(str(e))
# ---------- end usc_runall ----------
# ----
# continue with protecting 80% of available irradiance of neighbor roofs
output_directory_3 = Panel("")
list_4 = ValueList({"carve_fraction", "otsu", "headtail"}, selected="carve_fraction")
list_5 = ValueList({"tilted_plane", "time-based", "irradiance", "daylight", "benefit"}, selected="irradiance")
usc_threshold_2 = USCThreshold(method=list_4, value=Slider(0.8, range=0.1..1), carve_above=Toggle(True), carve_above_min="3")  # -> overrides; inputs method: String, value: Double, score_smoothing: Double, carve_above: Boolean, carve_above_min: Int32; same code as usc_threshold
usc_config_3 = USCConfig(
    session=usc_session.session,
    mode=list_5,
    epw_path=path_to_epw_if_required_by_mode,
    out_dir=output_directory_3,
    overrides=usc_threshold_2)  # -> config, summary; inputs mode: String, epw_path: String, out_dir: String, config_yaml: String, overrides: list of String; same code as usc_config
usc_runall_2 = USCRunPipeline(config=usc_config_3.config, max_volume=usc_runall.mesh, test_surfaces=neighbor_roofs, run=Toggle(False))  # -> mesh, export_path, report_path, diagnostics; inputs max_volume: list of Mesh, test_surfaces: list of Mesh, run: Boolean; same code as usc_runall

# ----
# you can specify period of interest (e.g. for time-based or irradiance mode)
panel_2 = Panel("12")
usc_period = USCAnalysisPeriod(start_month="12", start_day="21", start_hour="9", end_month=panel_2, end_day="21", end_hour="13")  # -> overrides; inputs start_month: Int32, start_day: Int32, start_hour: Int32, end_month: Int32, end_day: Int32, end_hour: Int32
# ---------- usc_period: Python ----------
"""USC Analysis Period — Define the time window for sun/sky analysis.

Required for: time-based, irradiance, benefit, radiative_cooling modes.
Optional for: daylight (CIE overcast is time-invariant; defaults to full year).
Not used by: tilted_plane.

Inputs
------
start_month : int (1-12)
start_day : int (1-31)
start_hour : int (0-23)
end_month : int (1-12)
end_day : int (1-31)
end_hour : int (0-23)

Outputs
-------
overrides : list of str
    Key=value pairs for the analysis period.
"""

try:
    ghenv.Component.Name = "USC Analysis Period"
    ghenv.Component.NickName = "USC_Period"
    ghenv.Component.Description = "Defines the time window for solar analysis. Required for time-based, irradiance, benefit, and radiative_cooling modes. Optional for daylight (time-invariant). Not needed for tilted_plane."
    ii = ghenv.Component.Params.Input
    oo = ghenv.Component.Params.Output
    for i, (n, d) in enumerate([
        ("start_month", "First month of the analysis window (1=January, 12=December). For heating-season studies, try 10 (October)."),
        ("start_day", "First day of the start month (1-31). Use 1 for the beginning of the month."),
        ("start_hour", "First hour of day to include (0-23, where 0=midnight, 12=noon). For daytime-only analysis, use 7 or 8."),
        ("end_month", "Last month of the analysis window (1-12). For heating-season studies, try 3 (March) or 4 (April)."),
        ("end_day", "Last day of the end month (1-31). Use 31 for the end of the month."),
        ("end_hour", "Last hour of day to include (0-23). For daytime-only analysis, use 17 or 18."),
    ]):
        if i < len(ii):
            ii[i].Name, ii[i].Description = n, d
    oo[0].Name, oo[0].Description = "overrides", "Time period settings formatted for USC_Config. Connect to Config's 'overrides' input."
except Exception:
    pass

# Output a single semicolon-delimited string so GH doesn't iterate
_items = []
for key, val in [
    ("start_month", start_month), ("start_day", start_day),
    ("start_hour", start_hour), ("end_month", end_month),
    ("end_day", end_day), ("end_hour", end_hour),
]:
    if val is not None:
        _items.append(f"{key}={int(val)}")
overrides = ";".join(_items) if _items else None
# ---------- end usc_period ----------

maximum_volume_to_carve = Geometry(building_footprints_extruded_to_max_heig)
test_surfaces_to_protect = Geometry(their_exposed_surfaces)

# ----
# 3. Preprocessing
# switch between histogram and sky plots
#  (depends on mode)
toggle_3 = BooleanToggle(True)
usc_preprocess = USCPreprocess(config=usc_config.config, max_volume=maximum_volume_to_carve, test_surfaces=test_surfaces_to_protect, run=toggle_3)  # -> pre_result, diagnostics, diag_images, test_points; inputs max_volume: list of Mesh, test_surfaces: list of Mesh, run: Boolean
# ---------- usc_preprocess: Python ----------
"""USC Preprocess — Run the ray-tracing stage (expensive, cache result).

Voxelizes the max volume, samples test surfaces, and casts rays through
the grid to compute per-voxel obstruction scores. This is the most
expensive step — only re-run when geometry, mode, or period changes.

Connect the pre_result output to USC Threshold.

Inputs
------
config : USCConfig
    Config handle from USC Config.
max_volume : Mesh or Brep (list)
    Maximum volume envelope geometry.
test_surfaces : Mesh or Brep (list)
    Insolation test surfaces.
run : bool
    True to execute. False to idle.

Outputs
-------
pre_result : str
    Path to preprocessing manifest.json.  Connect to USC Threshold Stage.
diagnostics : str
    Score statistics, grid info, timing.
diag_images : list of str
    Paths to diagnostic images (score histogram, sky patch plots).
    Feed to Ladybug Image Viewer for in-canvas inspection.
    Empty when diagnostics are disabled.
test_points : list of Point3d
    Sample points generated from test surfaces during preprocessing.
    Useful for verifying sampling density and surface coverage.
"""

import json
import os
import time
from pathlib import Path

import Rhino.Geometry as rg

# -- GH UI ------------------------------------------------------------------
try:
    ghenv.Component.Name = "USC Preprocess"
    ghenv.Component.NickName = "USC_Preprocess"
    ghenv.Component.Description = "Stage 1/4: Voxelizes the max volume and traces rays from test surfaces through the grid, computing per-voxel obstruction scores. This is the most computationally expensive step. Results are cached — only re-runs when geometry or mode changes."
    ii = ghenv.Component.Params.Input
    oo = ghenv.Component.Params.Output
    ii[0].Name, ii[0].Description = "config", "Configuration handle from USC_Config. Contains mode, file paths, and all parameter overrides."
    ii[1].Name, ii[1].Description = "max_volume", "The maximum building envelope -- the largest volume the building could occupy before solar carving. Provide as Rhino Mesh or Brep. Multiple objects accepted."
    ii[2].Name, ii[2].Description = "test_surfaces", "Surfaces that need solar access (neighbouring facades, public spaces, parks). Rays are cast FROM these surfaces THROUGH the max volume. Provide as Rhino Mesh or Brep (one or many). Surfaces are subsampled into a uniform point grid at grid_step spacing (set in USC_GridSettings) — each sample point generates rays, so smaller grid_step = more points = finer results but slower. IMPORTANT: each surface must be a single flat panel — explode polysurfaces (e.g. extruded block boundaries) into individual faces before connecting, otherwise preprocessing will fail with a planarity error."
    ii[3].Name, ii[3].Description = "run", "Boolean toggle to execute. Set True to run preprocessing. Set False to prevent computation (useful while adjusting parameters)."
    oo[0].Name, oo[0].Description = "pre_result", "Path to the preprocessing manifest file. Connect this to USC_ThresholdStage's 'pre_result' input to continue the pipeline."
    oo[1].Name, oo[1].Description = "diagnostics", "Text summary: grid dimensions, filled voxels, score range, timing. Check this to verify the preprocessing ran correctly."
    if len(oo) > 2:
        oo[2].Name, oo[2].Description = "diag_images", "Paths to diagnostic images (score histogram, sky patch weight/intensity plots). Feed to Ladybug Image Viewer for in-canvas visualisation. Empty when diagnostics are disabled."
    if len(oo) > 3:
        oo[3].Name, oo[3].Description = "test_points", "Sample points generated from test surfaces at grid_step spacing. Visualise in Rhino to verify sampling density and surface coverage. If too sparse, reduce grid_step in USC_GridSettings."
        # Hide test_points from component preview so they don't clutter the
        # viewport when the user enables geometry preview on the component.
        oo[3].Hidden = True
except Exception:
    pass

# -- Geometry helpers (shared with RunPipeline) ------------------------------

def _fine_mesh_params():
    """Meshing parameters that preserve geometry detail for carving."""
    mp = rg.MeshingParameters()
    mp.MaximumEdgeLength = 0  # no limit
    mp.MinimumEdgeLength = 0.001
    mp.GridAspectRatio = 0
    mp.GridAngle = 0  # refine at curvature
    mp.GridMaxCount = 0
    mp.RefineGrid = True
    mp.JaggedSeams = False
    mp.SimplePlanes = True  # don't over-tessellate flat faces
    mp.Tolerance = 0.01
    mp.RelativeTolerance = 0.0
    return mp

def _to_rhino_mesh(geom):
    """Convert Brep or Mesh to a triangulated Rhino Mesh."""
    if isinstance(geom, rg.Mesh):
        m = geom.DuplicateMesh()
        # Ensure all faces are triangles (trimesh expects this)
        m.Faces.ConvertQuadsToTriangles()
        m.Normals.ComputeNormals()
        m.Compact()
        return m
    if isinstance(geom, rg.Brep):
        meshes = rg.Mesh.CreateFromBrep(geom, _fine_mesh_params())
        if meshes:
            combined = rg.Mesh()
            for m in meshes:
                combined.Append(m)
            combined.Faces.ConvertQuadsToTriangles()
            # Weld seams: CreateFromBrep returns one mesh per Brep face,
            # Append leaves duplicate vertices at shared edges.
            combined.Vertices.CombineIdentical(True, True)
            combined.Faces.CullDegenerateFaces()
            combined.Normals.ComputeNormals()
            combined.Compact()
            return combined
    return None

def _flatten_geometry(items):
    """Extract Rhino Meshes from GH input (handles trees, wrappers, goo)."""
    if items is None:
        return []
    if not isinstance(items, (list, tuple)):
        items = [items]
    meshes = []
    for item in items:
        # Unwrap GH object wrappers (GH_ObjectWrapper, GH_MeshGoo, etc.)
        geo = item
        # Try .Value (GH_ObjectWrapper)
        if hasattr(geo, "Value"):
            geo = geo.Value
        # Try .CastTo for IGH_GeometricGoo
        if hasattr(geo, "CastToMesh"):
            m = rg.Mesh()
            if geo.CastToMesh(m):
                geo = m
        elif hasattr(geo, "CastTo"):
            try:
                success, result = geo.CastTo[rg.Mesh]()
                if success:
                    geo = result
            except Exception:
                pass
        m = _to_rhino_mesh(geo)
        if m is not None:
            meshes.append(m)
    return meshes

def _export_mesh_to_ply(mesh, path, include_normals=True):
    """Write a triangulated Rhino Mesh to binary PLY (little-endian).

    Uses .NET bulk array operations (ToFloatArray + Buffer.BlockCopy) to
    bypass per-vertex Python loops.  GhPython loops are significantly slower
    than C++/.NET bulk paths; this eliminates the vertex serialization
    bottleneck for large meshes.

    Parameters
    ----------
    include_normals : bool
        True for test surfaces (open/non-watertight) — normals let trimesh
        correctly orient faces via fix_normals().  False for max_volume
        (watertight) — explicit normals can cause trimesh to flip face winding
        during process=True loading, breaking inside/outside for voxelization
        (produces hollow shell instead of solid fill).
    """
    import struct
    import System

    mesh.Faces.ConvertQuadsToTriangles()
    mesh.Normals.ComputeNormals()
    nv = mesh.Vertices.Count
    nf = mesh.Faces.Count

    with open(path, "wb") as f:
        # -- Header --------------------------------------------------------
        props = "property float x\nproperty float y\nproperty float z\n"
        if include_normals:
            props += (
                "property float nx\nproperty float ny\nproperty float nz\n"
            )
        header = (
            "ply\nformat binary_little_endian 1.0\n"
            f"element vertex {nv}\n"
            f"{props}"
            f"element face {nf}\n"
            "property list uchar int vertex_indices\n"
            "end_header\n"
        )
        f.write(header.encode("ascii"))

        # -- Vertices (bulk .NET path) -------------------------------------
        # ToFloatArray() is a single C++ call returning float[nv*3]
        pos = mesh.Vertices.ToFloatArray()

        if include_normals:
            # Bulk normal extraction; fall back to per-element if the method
            # is unavailable in this Rhino version.
            try:
                nrm = mesh.Normals.ToFloatArray()
            except (AttributeError, TypeError):
                nrm = System.Array.CreateInstance(System.Single, nv * 3)
                norms_list = mesh.Normals
                for i in range(nv):
                    n = norms_list[i]
                    nrm[i * 3] = n.X
                    nrm[i * 3 + 1] = n.Y
                    nrm[i * 3 + 2] = n.Z

            # Interleave [x,y,z, nx,ny,nz] per vertex via .NET Array.Copy
            combined = System.Array.CreateInstance(System.Single, nv * 6)
            for i in range(nv):
                System.Array.Copy(pos, i * 3, combined, i * 6, 3)
                System.Array.Copy(nrm, i * 3, combined, i * 6 + 3, 3)

            nbytes = nv * 24
            vbuf = System.Array.CreateInstance(System.Byte, nbytes)
            System.Buffer.BlockCopy(combined, 0, vbuf, 0, nbytes)
            f.write(bytes(bytearray(vbuf)))
        else:
            # Zero Python loops: bulk extract → byte copy → write
            nbytes = nv * 12
            vbuf = System.Array.CreateInstance(System.Byte, nbytes)
            System.Buffer.BlockCopy(pos, 0, vbuf, 0, nbytes)
            f.write(bytes(bytearray(vbuf)))

        # -- Faces (all triangles after ConvertQuadsToTriangles) -----------
        faces = mesh.Faces
        fbuf = bytearray(nf * 13)  # 1 byte count + 3×4 byte indices
        for i in range(nf):
            face = faces[i]
            struct.pack_into("<Biii", fbuf, i * 13, 3, face.A, face.B, face.C)
        f.write(fbuf)

# -- RPC helper --------------------------------------------------------------

def _rpc_call(session, cmd, payload):
    from multiprocessing.connection import Client as MPClient
    authkey = getattr(session, "authkey", None)
    if authkey is None:
        raise RuntimeError("No daemon authkey — start the daemon first")
    c = MPClient((session.host, session.port), authkey=authkey)
    c.send({"cmd": cmd, **payload})
    resp = c.recv()
    c.close()
    if isinstance(resp, dict) and resp.get("status") == "error":
        raise RuntimeError(resp.get("error", "Unknown error"))
    return resp

# -- Main logic --------------------------------------------------------------

def _add_error(msg):
    """Surface an error on the GH component (turns it red) and return msg."""
    try:
        from Grasshopper.Kernel import GH_RuntimeMessageLevel
        ghenv.Component.AddRuntimeMessage(GH_RuntimeMessageLevel.Error, msg)
    except Exception:
        pass
    return msg


pre_result = None
diagnostics = ""
diag_images = []
test_points = []

if not run:
    diagnostics = "Idle — set run=True"
elif config is None:
    diagnostics = _add_error("Connect a USC Config component")
elif max_volume is None:
    diagnostics = _add_error("Connect max_volume geometry")
elif test_surfaces is None:
    diagnostics = _add_error("Connect test_surfaces geometry")
else:
    t_start = time.perf_counter()
    session = config.session
    out_dir = config.out_dir
    overrides = dict(config.overrides)

    # Export geometry to PLY
    vol_meshes = _flatten_geometry(max_volume)
    srf_meshes = _flatten_geometry(test_surfaces)

    if not vol_meshes:
        diagnostics = "ERROR: max_volume has no valid geometry"
    elif not srf_meshes:
        diagnostics = "ERROR: test_surfaces has no valid geometry"
    else:
        vol_combined = rg.Mesh()
        for m in vol_meshes:
            vol_combined.Append(m)
        # Weld seams left by Append: merge duplicate vertices at Brep face
        # boundaries so trimesh sees a manifold watertight mesh for solid
        # voxelization.  Without this, seams leave gaps → surface-only voxels
        # → binary_fill_holes fails → hollow volume.
        vol_combined.Vertices.CombineIdentical(True, True)
        vol_combined.Faces.CullDegenerateFaces()
        vol_combined.UnifyNormals()
        vol_combined.Compact()

        srf_combined = rg.Mesh()
        for m in srf_meshes:
            srf_combined.Append(m)
        # Do NOT weld test surfaces: CombineIdentical merges vertices
        # across different surfaces, corrupting vertex normals at shared
        # edges.  Trimesh's fix_normals() then flips faces wrong → rays
        # cast inward → partial carving.

        os.makedirs(out_dir, exist_ok=True)
        incoming = Path(out_dir) / "incoming"
        incoming.mkdir(exist_ok=True)

        vol_path = str(incoming / "max_volume.ply")
        srf_path = str(incoming / "test_surfaces.ply")
        _export_mesh_to_ply(vol_combined, vol_path, include_normals=False)
        _export_mesh_to_ply(srf_combined, srf_path, include_normals=True)

        overrides["max_volume_path"] = vol_path
        overrides["test_surface_path"] = srf_path

        try:
            pre_out = str(Path(out_dir) / "preprocessing")
            if getattr(session, "daemon_running", False):
                resp = _rpc_call(session, "preprocessing", {
                    "config": config.yaml_path,
                    "overrides": [f"{k}={v}" for k, v in overrides.items()],
                    "out_dir": pre_out,
                })
                pre_result = resp.get("manifest", "")
                # Read diagnostics
                elapsed = time.perf_counter() - t_start
                diag_lines = [f"Preprocessing: {elapsed:.1f}s"]
                summary_path = Path(pre_out) / "diagnostics" / "diagnostic.json"
                if summary_path.exists():
                    data = json.load(open(summary_path))
                    dev = data.get("device")
                    if dev:
                        diag_lines.append(f"Device: {dev}")
                    stats = data.get("score_stats", {})
                    diag_lines.append(f"Grid: {data.get('grid_shape', '?')}")
                    diag_lines.append(f"Filled voxels: {data.get('voxels_filled', '?')}")
                    diag_lines.append(f"Scores: [{stats.get('min', 0):.1f} - {stats.get('max', 0):.1f}]")
                    diag_lines.append(f"Test points: {data.get('test_surface_points', '?')}")
                    # Collect image paths for LB Image Viewer
                    hist = data.get("score_histogram")
                    if hist and os.path.isfile(hist):
                        diag_images.append(hist)
                    for p in data.get("sky_patch_images", []):
                        if os.path.isfile(p):
                            diag_images.append(p)
                    # Simulated-weights runs also record how the weights
                    # shifted the sky vs the simple balance-point rule.
                    cmp_img = data.get("sky_patch_comparison_image")
                    if cmp_img and os.path.isfile(cmp_img):
                        diag_images.append(cmp_img)
                    cmp_stats = data.get("sky_patch_comparison_stats")
                    if cmp_stats:
                        diag_lines.append(
                            "Simulated vs simple weights: "
                            f"{cmp_stats.get('mass_redistributed_pct', 0):.1f}% "
                            "of sky-weight mass redistributed "
                            f"({cmp_stats.get('patches_over_20pct', 0)} of 145 "
                            "patches changed by >20%)")
                diagnostics = "\n".join(diag_lines)
                # Load test points for GH output
                tp_path = Path(pre_out) / "test_points.npy"
                if tp_path.exists():
                    import numpy as _np
                    pts_arr = _np.load(str(tp_path))
                    test_points = [rg.Point3d(float(r[0]), float(r[1]), float(r[2])) for r in pts_arr]
            else:
                diagnostics = _add_error("Daemon not running — connect USC_Session and set start_daemon=True")

        except Exception as e:
            diagnostics = _add_error(str(e))
# ---------- end usc_preprocess ----------
imageviewer = LBImageViewer(ImagePath_=usc_preprocess.diag_images, _scale_=1, DisableClickable=False, SaveImgWithCoords=False, scale=1)  # -> ImagePath, Values, GIF

# ----
# 4. Thresholding
# carve fraction: the fraction of globally available
# score preserved after carving (depends on mode)
# Try different values.
list_6 = ValueList({"carve_fraction", "headtail"}, selected="carve_fraction")
usc_threshold_3 = USCThreshold(method=list_6, value=Slider(0.6, range=0..1))  # -> overrides; inputs method: String, value: Double, score_smoothing: Double, carve_above: Boolean, carve_above_min: Int32; same code as usc_threshold
usc_thrstage = USCThresholdStage(config=usc_config.config, pre_result=usc_preprocess.pre_result, threshold_overrides=usc_threshold_3, run=Toggle(True))  # -> thr_result, threshold_value, diagnostics, diag_images; inputs pre_result: String, threshold_overrides: String, run: Boolean
# ---------- usc_thrstage: Python ----------
"""USC Threshold Stage — Apply threshold to cached scores (fast, iterative).

Takes the preprocessing result and applies a threshold to create a binary
mask. This is FAST (<1 second) — adjust the threshold parameters and
re-run without waiting for ray tracing again.

IMPORTANT: Connect threshold overrides DIRECTLY here (not through Config).
This way, changing the threshold slider only re-runs this stage + Export,
not Preprocessing.

Inputs
------
config : USCConfig
    Config handle from USC Config (carries base settings, out_dir, session).
pre_result : str
    Preprocessing manifest path from USC Preprocess.
threshold_overrides : str, optional
    Threshold parameter overrides from USC Threshold component.
    Merged on top of config overrides — changes here do NOT trigger
    Preprocessing to re-run.
run : bool
    True to execute. False to idle.

Outputs
-------
thr_result : str
    Path to thresholding manifest.json.  Connect to USC Export.
threshold_value : float
    The resolved numeric threshold that was applied.
diagnostics : str
    Retention stats, method used, timing.
diag_images : list of str
    Path to threshold histogram image.
    Feed to Ladybug Image Viewer for in-canvas inspection.
    Empty when diagnostics are disabled.
"""

import json
import os
import time
from pathlib import Path

# -- GH UI ------------------------------------------------------------------
try:
    ghenv.Component.Name = "USC Threshold Stage"
    ghenv.Component.NickName = "USC_ThrStage"
    ghenv.Component.Description = "Stage 2/4: Applies a threshold to the score volume, producing a binary mask of voxels to keep. Fast (<1s) — change the threshold without re-running preprocessing."
    ii = ghenv.Component.Params.Input
    oo = ghenv.Component.Params.Output
    ii[0].Name, ii[0].Description = "config", "Configuration handle from USC_Config. Carries base settings and output directory."
    ii[1].Name, ii[1].Description = "pre_result", "Preprocessing manifest path from USC_Preprocess. Contains the score volume and grid metadata."
    ii[2].Name, ii[2].Description = "threshold_overrides", "Override string from USC_Threshold component. Connect DIRECTLY here (not through Config) so that changing the threshold slider only re-runs this stage and Export -- not the expensive Preprocessing step."
    ii[3].Name, ii[3].Description = "run", "Boolean toggle. True to execute thresholding."
    oo[0].Name, oo[0].Description = "thr_result", "Path to the thresholding manifest file. Connect to USC_Export's 'thr_result' input."
    oo[1].Name, oo[1].Description = "threshold_value", "The numeric threshold that was actually applied. Useful for understanding what the algorithm chose (especially with 'headtail' or 'carve_fraction')."
    oo[2].Name, oo[2].Description = "diagnostics", "Text summary: threshold method, value, voxel retention percentage, timing."
    if len(oo) > 3:
        oo[3].Name, oo[3].Description = "diag_images", "Path to the threshold histogram (shows score distribution with the threshold line). Feed to Ladybug Image Viewer. Empty when diagnostics are disabled."
except Exception:
    pass


# -- Helpers -----------------------------------------------------------------

def _parse_overrides(x):
    """Parse semicolon-joined override string(s) into a dict."""
    if x is None:
        return {}
    items = str(x).split(";") if isinstance(x, str) else []
    result = {}
    for item in items:
        item = item.strip()
        if "=" in item:
            k, v = item.split("=", 1)
            result[k.strip()] = v.strip()
    return result


def _rpc_call(session, cmd, payload):
    from multiprocessing.connection import Client as MPClient
    authkey = getattr(session, "authkey", None)
    if authkey is None:
        raise RuntimeError("No daemon authkey — start the daemon first")
    c = MPClient((session.host, session.port), authkey=authkey)
    c.send({"cmd": cmd, **payload})
    resp = c.recv()
    c.close()
    if isinstance(resp, dict) and resp.get("status") == "error":
        raise RuntimeError(resp.get("error", "Unknown error"))
    return resp


# -- Main logic --------------------------------------------------------------

def _add_error(msg):
    """Surface an error on the GH component (turns it red) and return msg."""
    try:
        from Grasshopper.Kernel import GH_RuntimeMessageLevel
        ghenv.Component.AddRuntimeMessage(GH_RuntimeMessageLevel.Error, msg)
    except Exception:
        pass
    return msg


thr_result = None
threshold_value = None
diagnostics = ""
diag_images = []

if not run:
    diagnostics = "Idle — set run=True"
elif config is None:
    diagnostics = _add_error("Connect a USC Config component")
elif pre_result is None:
    diagnostics = _add_error("Connect pre_result from USC Preprocess")
else:
    t_start = time.perf_counter()
    session = config.session
    out_dir = config.out_dir

    # Start with config overrides, then merge threshold-specific ones on top.
    # This means threshold_overrides changes do NOT change config → do NOT
    # trigger Preprocessing to re-run.
    overrides = dict(config.overrides)
    thr_ovr = _parse_overrides(threshold_overrides)
    overrides.update(thr_ovr)

    try:
        thr_out = str(Path(out_dir) / "thresholding")
        if getattr(session, "daemon_running", False):
            resp = _rpc_call(session, "thresholding", {
                "from": str(pre_result),
                "config": config.yaml_path,
                "overrides": [f"{k}={v}" for k, v in overrides.items()],
                "out_dir": thr_out,
            })
            # Use daemon response if available, otherwise construct from known path
            thr_manifest = resp.get("manifest", "")
            if not thr_manifest or not Path(thr_manifest).is_file():
                thr_manifest = str(Path(thr_out) / "manifest.json")
            thr_result = thr_manifest
            # Read diagnostics
            elapsed = time.perf_counter() - t_start
            diag_lines = [f"Thresholding: {elapsed:.1f}s"]
            summary_path = Path(thr_out) / "diagnostics" / "diagnostic.json"
            if summary_path.exists():
                data = json.load(open(summary_path))
                threshold_value = data.get("threshold_value")
                diag_lines.append(f"Method: {data.get('threshold_method', '?')}")
                diag_lines.append(f"Threshold: {threshold_value}")
                diag_lines.append(f"Kept: {data.get('retention_pct', '?')}%")
                diag_lines.append(f"Voxels kept: {data.get('voxels_kept', '?')} / {data.get('voxels_total', '?')}")
                # Collect histogram path for LB Image Viewer
                hist = data.get("threshold_histogram")
                if hist and os.path.isfile(hist):
                    diag_images.append(hist)
            diagnostics = "\n".join(diag_lines)
        else:
            diagnostics = _add_error("Daemon not running — connect USC_Session and set start_daemon=True")

    except Exception as e:
        diagnostics = _add_error(str(e))
# ---------- end usc_thrstage ----------
imageviewer_2 = LBImageViewer(ImagePath_=usc_thrstage.diag_images, _scale_=1, DisableClickable=False, SaveImgWithCoords=False, scale=1)  # -> ImagePath, Values, GIF

# ----
# for tilted plane specify an angle or angle per
# direction (8 dirs, starting from north, clockwise)
panel_3 = Panel("""45
40
35
30
25
39
35
40""")  # disabled
panel_4 = Panel("45")  # disabled
usc_plane = USCTiltedPlane(angle=panel_4)  # -> overrides; inputs angle: Double, octants: list of Double; disabled
# ---------- usc_plane: Python ----------
"""USC Tilted Plane — Set plane angles for daylight envelope carving.

Only used when mode = "tilted_plane".

Provide EITHER:
  - angle: a single number applied uniformly to all 8 octants
  - octants: exactly 8 numbers [N, NE, E, SE, S, SW, W, NW]

If both are connected, octants takes precedence.

Inputs
------
angle : float, optional
    Single plane angle in degrees applied uniformly.
octants : list of 8 floats, optional
    Per-octant angles [N, NE, E, SE, S, SW, W, NW] in degrees.

Outputs
-------
overrides : str
    Semicolon-joined key=value string.
"""

try:
    ghenv.Component.Name = "USC Tilted Plane"
    ghenv.Component.NickName = "USC_Plane"
    ghenv.Component.Description = "Sets the daylight access angle for tilted_plane mode. Provide a single angle (uniform) or 8 per-octant values [N,NE,E,SE,S,SW,W,NW]. The angle defines the slope of the daylight access plane from horizontal."
    ii = ghenv.Component.Params.Input
    oo = ghenv.Component.Params.Output
    ii[0].Name, ii[0].Description = "angle", "Single daylight access angle in degrees, applied uniformly to all directions. This is the angle between the horizontal ground plane and the daylight access plane. 45 deg means 1:1 height-to-distance ratio. Range: 10-80 deg."
    ii[1].Name, ii[1].Description = "octants", "Eight angles in degrees, one per cardinal/intercardinal direction [N, NE, E, SE, S, SW, W, NW]. Use this instead of 'angle' when different directions need different daylight access. Provide exactly 8 values."
    oo[0].Name, oo[0].Description = "overrides", "Tilted plane settings formatted for USC_Config. Connect to Config's 'overrides' input. Only relevant when mode='tilted_plane'."
    # octants must be List Access so GH collects all 8 values at once
    import Grasshopper
    ii[1].Access = Grasshopper.Kernel.GH_ParamAccess.list
except Exception:
    pass


def _to_float_list(x):
    """Convert whatever GH sends into a flat list of floats."""
    if x is None:
        return []
    if isinstance(x, (int, float)):
        return [float(x)]
    out = []
    for item in x:
        try:
            out.append(float(item))
        except (TypeError, ValueError):
            pass
    return out


overrides = None

oct_vals = _to_float_list(octants)
if len(oct_vals) == 8:
    # Per-octant mode
    import json as _json
    overrides = "tilted_plane_angle_deg=" + _json.dumps(oct_vals)
elif len(oct_vals) > 0 and len(oct_vals) != 8:
    overrides = None
    try:
        import Grasshopper as _gh
        ghenv.Component.AddRuntimeMessage(
            _gh.Kernel.GH_RuntimeMessageLevel.Warning,
            "octants needs exactly 8 values, got {}".format(len(oct_vals))
        )
    except Exception:
        pass
elif angle is not None:
    # Uniform angle
    overrides = "tilted_plane_angle_deg={}".format(float(angle))
# ---------- end usc_plane ----------

preview = CustomPreview(Geometry=usc_runall_2.mesh, Material=ColourSwatch(SwatchColor=RGB(92, 255, 141)))

# ----
# 5. Postprocessing
# switch off smoothing for faster preview
toggle_4 = BooleanToggle(False)
usc_postproc = USCPostprocess(apply_smoothing=toggle_4)  # -> overrides; inputs apply_smoothing: Boolean, smooth_iters: Int32, min_voxels: Int32, min_faces: Int32
# ---------- usc_postproc: Python ----------
"""USC Postprocess — Control mesh cleanup and smoothing.

Generates override strings for the exporting stage's mesh extraction.
Connect the output to USC Config's ``overrides`` input.

Inputs
------
apply_smoothing : bool, optional
    True = SDF smooth + marching cubes.  False = raw cubic mesh (default).
smooth_iters : int, optional
    Taubin polish passes (only with smoothing).  Default: 2.
min_voxels : int, optional
    Minimum connected voxel cluster to keep.  Default: 300.
min_faces : int, optional
    Minimum face count to keep mesh fragment.  Default: 100.

Outputs
-------
overrides : str
    Semicolon-joined key=value pairs. Connect to USC Export's
    ``postprocess_overrides`` input — changes here only re-run Export,
    not Preprocessing or Thresholding.
"""

try:
    ghenv.Component.Name = "USC Postprocess"
    ghenv.Component.NickName = "USC_PostProc"
    ghenv.Component.Description = "Controls mesh postprocessing: smoothing method, iteration count, and minimum cluster sizes for noise removal."
    ii = ghenv.Component.Params.Input
    oo = ghenv.Component.Params.Output
    for i, (n, d) in enumerate([
        ("apply_smoothing", "True = smooth the voxel result using SDF + marching cubes (produces organic-looking surfaces). False = keep raw cubic voxel geometry (faster, preserves exact voxel boundaries). Default: False."),
        ("smooth_iters", "Number of Taubin mesh polishing passes (only when smoothing is enabled). More iterations = smoother but may lose detail. Default: 2. Range: 0-10."),
        ("min_voxels", "Minimum number of connected voxels in a cluster to keep. Smaller clusters are discarded as noise. Default: 300. Reduce for small-scale models."),
        ("min_faces", "Minimum number of mesh faces in a fragment to keep. Small disconnected mesh pieces below this count are removed. Default: 100."),
    ]):
        if i < len(ii):
            ii[i].Name, ii[i].Description = n, d
    oo[0].Name, oo[0].Description = "overrides", "Postprocessing settings as a semicolon-joined override string. Connect to USC_Export's 'postprocess_overrides' input — changes here will only re-run Export, not Preprocessing or Thresholding."
except Exception:
    pass

_items = []
if apply_smoothing is not None:
    _items.append(f"apply_smoothing={'true' if bool(apply_smoothing) else 'false'}")
for key, val in [
    ("smooth_iters", smooth_iters),
    ("min_voxels", min_voxels),
    ("min_face_count", min_faces),
]:
    if val is not None:
        _items.append(f"{key}={int(val)}")
overrides = ";".join(_items) if _items else None
# ---------- end usc_postproc ----------
usc_export = USCExport(config=usc_config.config, thr_result=usc_thrstage.thr_result, postprocess_overrides=usc_postproc, run=Toggle(True))  # -> mesh, export_path, report_path, diagnostics; inputs thr_result: String, postprocess_overrides: String, run: Boolean
# ---------- usc_export: Python ----------
"""USC Export — Convert binary mask to mesh (fast, returns to Rhino).

Takes the thresholding result and reconstructs a triangle mesh from the
carved voxel field. Returns the mesh directly to Grasshopper.

This is fast — runs in 1-3 seconds.

Inputs
------
config : USCConfig
    Config handle from USC Config.
thr_result : str
    Thresholding manifest path from USC Threshold Stage.
postprocess_overrides : str, optional
    Postprocessing parameter overrides from USC Postprocess component.
    Connect DIRECTLY here (not through Config) so that changing smoothing
    or cleanup settings only re-runs Export — not Preprocessing or
    Thresholding.
run : bool
    True to execute. False to idle.

Outputs
-------
mesh : Rhino.Geometry.Mesh
    Carved envelope mesh, ready for display in Rhino.
export_path : str
    Path to the exported mesh file on disk.
report_path : str
    Path to the run_report.md file summarising the full pipeline run.
diagnostics : str
    Mesh stats (vertices, faces, volume), timing.
"""

import json
import os
import time
from pathlib import Path

import Rhino.Geometry as rg

# -- GH UI ------------------------------------------------------------------
try:
    ghenv.Component.Name = "USC Export"
    ghenv.Component.NickName = "USC_Export"
    ghenv.Component.Description = "Stage 3: Converts the binary voxel mask into a triangle mesh and returns it to the Grasshopper canvas. Also saves the mesh to disk."
    ii = ghenv.Component.Params.Input
    oo = ghenv.Component.Params.Output
    ii[0].Name, ii[0].Description = "config", "Configuration handle from USC_Config."
    ii[1].Name, ii[1].Description = "thr_result", "Thresholding manifest path from USC_ThresholdStage."
    ii[2].Name, ii[2].Description = "postprocess_overrides", "Override string from USC_Postprocess component. Connect DIRECTLY here (not through Config) so that changing smoothing or cleanup settings only re-runs Export — not the expensive Preprocessing or Thresholding steps."
    ii[3].Name, ii[3].Description = "run", "Boolean toggle. True to extract and return the mesh."
    oo[0].Name, oo[0].Description = "mesh", "The carved envelope as a Rhino Mesh, displayed directly in the viewport. This is the main result -- bake it, export it, or use it in downstream Grasshopper operations."
    oo[1].Name, oo[1].Description = "export_path", "Full path to the mesh file saved on disk (PLY format by default). Useful if you need to open the result in another application."
    oo[2].Name, oo[2].Description = "report_path", "Full path to the run_report.md file. Contains a human-readable summary of the entire pipeline run: configuration, scores, thresholding, mesh stats, and timings."
    oo[3].Name, oo[3].Description = "diagnostics", "Text summary: vertex/face counts, mesh volume, bounding box dimensions, timing."
except Exception:
    pass

# -- PLY loader --------------------------------------------------------------

def _load_ply_to_rhino(path):
    """Load a PLY file into Rhino Mesh using batch array operations.

    Parses binary-LE or ASCII PLY, handling arbitrary vertex property layouts
    (e.g. x/y/z/nx/ny/nz when trimesh exports normals after fix_normals()).
    Uses the actual per-vertex byte stride from the header so that x/y/z are
    read at the correct offsets regardless of how many extra properties exist.

    Uses System.Array-based AddVertices/AddFaces for ~10-50x speedup over
    per-element Add calls.  Face data is read in a single I/O call and
    parsed with struct.unpack_from to avoid 2×nf individual f.read() calls.
    """
    import struct
    import System

    _PLY_SIZES = {
        "char": 1, "uchar": 1, "short": 2, "ushort": 2,
        "int": 4, "uint": 4, "float": 4, "double": 8,
        "int8": 1, "uint8": 1, "int16": 2, "uint16": 2,
        "int32": 4, "uint32": 4, "float32": 4, "float64": 8,
    }

    nv = nf = 0
    is_binary_le = False
    vertex_props = []   # [(name, byte_size), ...]
    in_vertex = False

    with open(path, "rb") as f:
        # Parse header — track vertex property list to compute stride
        first = True
        while True:
            raw_line = f.readline()
            if not raw_line:
                # EOF before end_header: not a PLY (or truncated).  Without
                # this guard, readline() returns b"" forever → infinite loop.
                raise ValueError(
                    "Not a valid PLY file (no end_header found): {}".format(path)
                )
            line = raw_line.decode("ascii", errors="replace").strip()
            if first:
                if line != "ply":
                    raise ValueError(
                        "Not a PLY file (missing 'ply' magic): {}".format(path)
                    )
                first = False
                continue
            if line == "end_header":
                break
            if "binary_little_endian" in line:
                is_binary_le = True
            elif line.startswith("element vertex"):
                nv = int(line.split()[-1])
                in_vertex = True
                vertex_props = []
            elif line.startswith("element"):
                in_vertex = False
                if "face" in line:
                    nf = int(line.split()[-1])
            elif line.startswith("property") and in_vertex:
                parts = line.split()
                if len(parts) >= 3 and parts[1] != "list":
                    vertex_props.append((parts[2], _PLY_SIZES.get(parts[1], 4)))

        # Compute per-vertex byte stride and x/y/z offsets
        stride = sum(sz for _, sz in vertex_props) or 12
        xyz_off = {}
        off = 0
        for pname, psize in vertex_props:
            if pname in ("x", "y", "z"):
                xyz_off[pname] = off
            off += psize
        xo = xyz_off.get("x", 0)
        yo = xyz_off.get("y", 4)
        zo = xyz_off.get("z", 8)

        # Read raw data
        if is_binary_le:
            raw = f.read(nv * stride)
            if stride == 12 and xo == 0 and yo == 4 and zo == 8:
                # Fast path: xyz-only layout (trimesh default, no normals)
                verts = struct.unpack(f"<{nv * 3}f", raw)
            else:
                # General path: extract x/y/z at their actual byte offsets
                verts = []
                for i in range(nv):
                    base = i * stride
                    verts.append(struct.unpack_from("<f", raw, base + xo)[0])
                    verts.append(struct.unpack_from("<f", raw, base + yo)[0])
                    verts.append(struct.unpack_from("<f", raw, base + zo)[0])
            # Bulk-read all face data at once (avoids 2×nf individual reads)
            face_data = f.read()
            faces = []
            foff = 0
            for _ in range(nf):
                count = struct.unpack_from("<B", face_data, foff)[0]
                foff += 1
                faces.append(
                    struct.unpack_from(f"<{count}i", face_data, foff)
                )
                foff += count * 4
        else:
            f.seek(0)
            text = f.read().decode("ascii", errors="replace").split("\n")
            ds = 0
            for i, ln in enumerate(text):
                if ln.strip() == "end_header":
                    ds = i + 1
                    break
            verts = []
            for i in range(nv):
                p = text[ds + i].split()
                verts.extend((float(p[0]), float(p[1]), float(p[2])))
            faces = []
            for i in range(nf):
                p = text[ds + nv + i].split()
                c = int(p[0])
                faces.append(tuple(int(x) for x in p[1:c + 1]))

    # Batch-build Rhino mesh
    mesh_out = rg.Mesh()

    # Vertices: .NET array of Point3f → single AddVertices call
    pt_arr = System.Array.CreateInstance(rg.Point3d, nv)
    for i in range(nv):
        pt_arr[i] = rg.Point3d(verts[i * 3], verts[i * 3 + 1], verts[i * 3 + 2])
    mesh_out.Vertices.AddVertices(pt_arr)

    # Faces: .NET array of MeshFace → single AddFaces call
    face_arr = System.Array.CreateInstance(rg.MeshFace, nf)
    for i, idx in enumerate(faces):
        if len(idx) == 3:
            face_arr[i] = rg.MeshFace(idx[0], idx[1], idx[2])
        else:
            face_arr[i] = rg.MeshFace(idx[0], idx[1], idx[2], idx[3])
    mesh_out.Faces.AddFaces(face_arr)

    mesh_out.Normals.ComputeNormals()
    return mesh_out

# -- Helpers -----------------------------------------------------------------

def _parse_overrides(x):
    """Parse semicolon-joined override string(s) into a dict."""
    if x is None:
        return {}
    items = str(x).split(";") if isinstance(x, str) else []
    result = {}
    for item in items:
        item = item.strip()
        if "=" in item:
            k, v = item.split("=", 1)
            result[k.strip()] = v.strip()
    return result


# -- RPC helper --------------------------------------------------------------

def _rpc_call(session, cmd, payload):
    from multiprocessing.connection import Client as MPClient
    authkey = getattr(session, "authkey", None)
    if authkey is None:
        raise RuntimeError("No daemon authkey — start the daemon first")
    c = MPClient((session.host, session.port), authkey=authkey)
    c.send({"cmd": cmd, **payload})
    resp = c.recv()
    c.close()
    if isinstance(resp, dict) and resp.get("status") == "error":
        raise RuntimeError(resp.get("error", "Unknown error"))
    return resp

# -- Main logic --------------------------------------------------------------

def _add_error(msg):
    """Surface an error on the GH component (turns it red) and return msg."""
    try:
        from Grasshopper.Kernel import GH_RuntimeMessageLevel
        ghenv.Component.AddRuntimeMessage(GH_RuntimeMessageLevel.Error, msg)
    except Exception:
        pass
    return msg


mesh = None
export_path = None
report_path = None
diagnostics = ""

if not run:
    diagnostics = "Idle — set run=True"
elif config is None:
    diagnostics = _add_error("Connect a USC Config component")
elif thr_result is None:
    diagnostics = _add_error("Connect thr_result from USC Threshold Stage")
else:
    t_start = time.perf_counter()
    session = config.session
    out_dir = config.out_dir

    # Start with config overrides, then merge postprocess-specific ones on top.
    # This means postprocess_overrides changes do NOT touch config → do NOT
    # trigger Preprocessing or Thresholding to re-run.
    overrides = dict(config.overrides)
    pp_ovr = _parse_overrides(postprocess_overrides)
    overrides.update(pp_ovr)

    try:
        exp_out = str(Path(out_dir) / "exporting")
        if getattr(session, "daemon_running", False):
            resp = _rpc_call(session, "exporting", {
                "from": str(thr_result),
                "config": config.yaml_path,
                "overrides": [f"{k}={v}" for k, v in overrides.items()],
                "out_dir": exp_out,
            })
            result_path = resp.get("export_path", "")
            if result_path and os.path.isfile(result_path):
                export_path = result_path
                if result_path.lower().endswith(".ply"):
                    mesh = _load_ply_to_rhino(result_path)
                else:
                    # Non-PLY export formats (obj/stl/glb) are saved to disk
                    # but not previewed — the in-canvas loader is PLY-only.
                    try:
                        from Grasshopper.Kernel import GH_RuntimeMessageLevel
                        ghenv.Component.AddRuntimeMessage(
                            GH_RuntimeMessageLevel.Remark,
                            "Mesh saved to {} — canvas preview only supports "
                            "PLY (set final_mesh_format=ply to preview)".format(result_path),
                        )
                    except Exception:
                        pass
            # Read diagnostics
            elapsed = time.perf_counter() - t_start
            diag_lines = [f"Exporting: {elapsed:.1f}s"]
            summary_path = Path(exp_out) / "diagnostics" / "diagnostic.json"
            if summary_path.exists():
                data = json.load(open(summary_path))
                diag_lines.append(f"Vertices: {data.get('vertices', '?')}")
                diag_lines.append(f"Triangles: {data.get('triangles', '?')}")
                vol = data.get("mesh_volume_m3")
                if vol is not None:
                    diag_lines.append(f"Volume: {vol:.1f} m3")
                bbox = data.get("bbox_dimensions_m")
                if bbox:
                    diag_lines.append(f"BBox: {bbox[0]:.1f} x {bbox[1]:.1f} x {bbox[2]:.1f} m")
                ret = data.get("voxel_retention_pct")
                if ret is not None:
                    diag_lines.append(f"Voxel retention: {ret}%")
            # Run report
            rpt = Path(exp_out).parent / "run_report.md"
            if rpt.is_file():
                report_path = str(rpt)
            diagnostics = "\n".join(diag_lines)
        else:
            diagnostics = _add_error("Daemon not running — connect USC_Session and set start_daemon=True")
            result_path = None

    except Exception as e:
        diagnostics = _add_error(str(e))
# ---------- end usc_export ----------

# ----
# Basic usage
output_mesh = Geometry(usc_export.mesh)

preview_2 = CustomPreview(Geometry=output_mesh, Material=ColourSwatch(SwatchColor=RGB(120, 118, 115)))

# ----
# read report (markdown)
file = ReadFile(File=usc_export.report_path, PerLineParse=True)
panel_5 = Panel(file)
